# Grasshopper definition 00_point_in_time_gridbased.gh (Grasshopper 1.0.7)

# Point in time daylight simulation aka Grid-based
# This is the same as grid-based daylight simulation in honeybee.
txt = Text("https://www.energyplus.net/weather-download/north_and_central_america_wmo_region_4/USA/IL/USA_IL_Chicago-OHare.725300_TMY2/all")
downloadweather = LadybugPlus_DownloadWeather(weather_URL=txt)  # -> epw_file, stat_file, ddy_file; plug-in component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
path = FilePath(downloadweather.epw_file)
# Geometry Preparation
number_slider = Slider(0.762, range=0..1)
wea = HoneybeePlus_WEAFromEPW(epw_file=path)  # -> wea; plug-in component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
# Room geometry except for the openings.
# Types and materials will be assigned
# based on normal direction.
# 
# These geometries are under ./scene/opaque
panel = Panel("0.55")
importloc = LadybugPlus_ImportLocation(epw_file=path)  # -> location; plug-in component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

# ---- group: opaque surfaces
brep = Brep([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])
wires = BrepWireframe(Brep=brep, Density=-1)
preview = CustomPreview(Geometry=wires, Shader=ColourSwatch(SwatchColor=RGB(0, 0, 0)))
hbsurface = HoneybeePlus_HoneybeeSurface(geo=brep)  # -> report, HB_srf; plug-in component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

# ---- group: context!
brep_2 = Brep([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])
debrep = DeconstructBrep(Brep=brep_2)  # -> flatten(Faces), Edges, Vertices

# ----
# Generate test points
# You can use any other grasshopper
# components to generate these points.
brep_3 = Brep([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])
# Windows are added to the scene
# as normal windows. They will be grouped
# together with room geometries.
# check ./scene/glazing
brep_4 = Brep([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])
panel_2 = Panel("21")
gentestpts = Honeybee_GenerateTestPoints(testGeometry=brep_3, gridSize="1", distBaseSrf=number_slider, moveTestMesh=True)  # -> readMe, simplify(testPoints), simplify(ptsVectors), simplify(facesArea), simplify(mesh); plug-in component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
wires_2 = BrepWireframe(Brep=brep_3, Density=-1)
radglassmat = HoneybeePlus_RadianceGlassMaterial(name="g_material", t_vis=panel)  # -> material; plug-in component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
hbsurface_2 = HoneybeePlus_HoneybeeSurface(geo=debrep.Faces)  # -> report, HB_srf; plug-in component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
ciesky = HoneybeePlus_CIEStandardSky(location=importloc, month=6, day=21, type=0)  # -> sky; plug-in component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
# Sky
# Use any of the sky components to
# generate the sky for the simulation.
# 
# Sky will be created under ./sky folder.
climatebased = HoneybeePlus_ClimatebasedSky(wea=wea, month="9", hour="9")  # -> sky; plug-in component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
preview_2 = CustomPreview(Geometry=brep_4, Shader=ColourSwatch(SwatchColor=RGBA(65, 114, 255, 72)))
certainillum = HoneybeePlus_CertainIlluminance()  # -> sky; plug-in component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
panel_3 = Panel(radglassmat)
panel_4 = Panel("""room_a
room_b""")
hbwinsrf = HoneybeePlus_HoneybeeWindowSurface(geo=brep_4, rad_mat=radglassmat)  # -> report, HB_win_srf; plug-in component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
data = Data(climatebased)
graft = GraftTree(Tree=panel_4, IncludeEmptyLists=True, IncludeNullItems=True)
# Analysis Grid
analysisgrid = HoneybeePlus_AnalysisGrid(name=graft, test_points=gentestpts.testPoints)  # -> analysis_grid; plug-in component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
flatten = FlattenTree(Tree=analysisgrid, Path="{0}")
data_2 = Data(flatten([hbsurface_2.HB_srf, hbsurface.HB_srf, hbwinsrf.HB_win_srf]))
# Recipe
# Run the simulation
gridbasedrecipe = HoneybeePlus_GridBasedRecipe(sky=data, analysis_grids=flatten, analysis_type=0)  # -> analysis_recipe; plug-in component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
toggle = BooleanToggle(False)
# Set write to True to save the files to
# the project folder. This gives you the
# option to check the files before running
# the simulation.
# 
# Once ready also set run to True and the
# component will run the study. The output
# will be the analysis grids or an image
# collection based on the analysis type.
# 
# Results will be stored under ./result
panel_5 = Panel("hbp_sample_file")
runradiance = HoneybeePlus_RunRadianceAnalysis(analysis_recipe=gridbasedrecipe, HB_objects=data_2, folder="c:\ladybug", name=panel_5, write=toggle, run=toggle)  # -> report, legend_par, outputs; plug-in component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
panel_6 = Panel(runradiance.report)
# Post process
# Result visualization
# In case of grid-based analysis the result
# is only available for the single hour of
# the simulation.
hourlyvalues = HoneybeePlus_HourlyValues(analysis_grid=runradiance.outputs)  # -> report, values; plug-in component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
panel_7 = Panel(hourlyvalues.report)

# ---- group: temporary solution until ladybug[+] is ready!
python = PythonScript(x=runradiance.legend_par)  # -> a, b, c, d
# ---------- python: Python ----------
from System.Drawing import Color
if x:
    a = x.min
    b = x.max
    c = 11
    d = (Color.FromArgb(1, c.r, c.g, c.b) for c in x.colors)
# ---------- end python ----------

# ----
legendpar = Ladybug_LegendParameters(lowBound=python.a, highBound=python.b, numSegments=python.c, customColors=flatten(python.d))  # -> legendPar; plug-in component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
flatten_2 = FlattenTree(Tree=hourlyvalues.values, Path="{0}")
panel_8 = Panel("""point in time
simulation""")
flatten_3 = FlattenTree(Tree=gentestpts.mesh, Path="{0}")
mjoin = MeshJoin(Meshes=flatten_3)
recolormesh = Ladybug_RecolorMesh(analysisResult=flatten_2, inputMesh=mjoin, legendPar=legendpar, analysisTitle=panel_8, legendTitle="lux")  # -> readMe, newMesh, newLegend, legendBasePt, meshColors, legendColors; plug-in component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
ladybug = Ladybug_Ladybug()  # -> Vviiiiiiiiiizzz; plug-in component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
