# Grasshopper definition 00_solaraccess.gh (Grasshopper 0.9.76)
# plug-ins: Python Interpreter

number_slider = Slider(11, range=0..100)
constructlocation = Ladybug_ConstructLocation(locationName="unknown_Location", latitude="36", longitude=0, timeZone=0, elevation=0)  # -> location; plug-in component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
series = Series(Start="1", Step=1, Count="12")
series_2 = Series(Start=0, Step=1, Count="24")
sunpath = Ladybug_SunPath(
    location=constructlocation,
    hour=series_2,
    day=Slider(10, range=0..10),
    month=series,
    timeStep=1,
    sunPathScale=Slider(0.2, range=0..1),
    dailyOrAnnualSunPath=True)  # -> readMe, sunVectors, sunAltitudes, sunAzimuths, port, sunSpheresMesh, sunPathCrvs, compassCrvs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; plug-in component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
ladybug = Ladybug_Ladybug()  # -> Vviiiiiiiiiizzz; plug-in component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
brep = Brep(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)
radglassmaterial = HoneybeePlus_RadianceGlassMaterial(name="g_material", TVis=".6")  # -> material; plug-in component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
radopaquematerial = HoneybeePlus_RadianceOpaqueMaterial(name="wall", reflect=".55", spec=0, rough=0)  # -> material; plug-in component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
brep_2 = Brep(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)
wires = BrepWireframe(Brep=brep, Density=-1)
gentestpts = Honeybee_GenerateTestPoints(testGeometry=brep, gridSize="1", distBaseSrf=Slider(0.762, range=0..1), moveTestMesh=True)  # -> readMe, simplify(testPoints), simplify(ptsVectors), simplify(facesArea), simplify(mesh); plug-in component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
panel = Panel(radglassmaterial)
preview = CustomPreview(Geometry=brep_2, Shader=ColourSwatch(SwatchColor=RGBA(211, 208, 255, 64)))
wires_2 = BrepWireframe(Brep=brep_2, Density=-1)
panel_2 = Panel(radopaquematerial)
brep_3 = Brep([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])
brep_4 = Brep(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)
wires_3 = BrepWireframe(Brep=brep_3, Density=-1)
debrep = DeconstructBrep(Brep=brep_4)  # -> Faces, Edges, Vertices
hbwinsrf = HoneybeePlus_HoneybeeWindowSurface(geo=brep_2, name="glass_wall", radMat=radglassmaterial)  # -> report, HBWinSrf; plug-in component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
analysisgrid = HoneybeePlus_AnalysisGrid(name="test_room", testPoints=gentestpts.testPoints, ptsVectors=gentestpts.ptsVectors)  # -> analysisGrid; plug-in component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
hbsurface = HoneybeePlus_HoneybeeSurface(geo=brep_3, radMat=radopaquematerial)  # -> report, HBSrf; plug-in component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
hbsurface_2 = HoneybeePlus_HoneybeeSurface(geo=debrep.Faces)  # -> report, HBSrf; plug-in component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

# ---- group: visualizeGeometry
python = PythonScript()  # -> geo; inputs HBObjs: list
# ---------- python: Python ----------
geo = (hbo.geometry for hbo in HBObjs if hasattr(hbo, 'geometry'))
# ---------- end python ----------

# ----
python_2 = PythonScript()  # -> out, a
# ---------- python_2: Python ----------
import honeybee
reload(honeybee.radiance.analysispoint)
reload(honeybee.radiance.analysisgrid)
# ---------- end python_2 ----------
solaraccessrecipe = HoneybeePlus_SolarAccessRecipe(sunVectors=sunpath.sunVectors, hoys=sunpath.sunPositionsHOY, analysisGrids=analysisgrid)  # -> analysisRecipe; plug-in component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
outdoorcomfortcalculator = Ladybug_OutdoorComfortCalculator()  # -> readMe, port, universalThermalClimateIndex, comfortableOrNot, thermalStress, conditionOfPerson, port_2, percentOfTimeComfortable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; plug-in component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
panel_3 = Panel("test room")
data = Data(flatten([hbsurface_2.HBSrf, hbsurface.HBSrf, hbwinsrf.HBWinSrf]))
toggle = BooleanToggle(False)
panel_4 = Panel(solaraccessrecipe)
runradiance = HoneybeePlus_RunRadianceAnalysis(analysisRecipe=solaraccessrecipe, HBObjects=data, folder="c:\ladybug", name="untitled", write=toggle, run=toggle)  # -> readMe, legendPar, results; plug-in component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
panel_5 = Panel(runradiance.readMe)

# ---- group: temporary solution until ladybug[+] is ready!
python_3 = PythonScript(x=runradiance.legendPar)  # -> a, b, c, d
# ---------- python_3: Python ----------
from System.Drawing import Color
if x:
    a = x.domain[0]
    b = x.domain[-1]
    c = 11
    d = (Color.FromArgb(1, c.r, c.g, c.b) for c in x.colors)
# ---------- end python_3 ----------

# ----
hourlyvalues = HoneybeePlus_HourlyValues(analysisGrid=runradiance.results)  # -> report, values; plug-in component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
cumvalue = HoneybeePlus_CumulativeValue(analysisGrid=runradiance.results)  # -> report, values; plug-in component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
legendpar = Ladybug_LegendParameters(lowBound=python_3.a, numSegments=python_3.c, customColors=flatten(python_3.d))  # -> legendPar; plug-in component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
panel_6 = Panel(hourlyvalues.report)
num = Number(cumvalue.values)
recolormesh = Ladybug_RecolorMesh(analysisResult=num, inputMesh=gentestpts.mesh, legendPar=legendpar, legendTitle="hours")  # -> readMe, newMesh, newLegend, legendBasePt, meshColors, legendColors; plug-in component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
