# Grasshopper definition 01_gridbased_analysis.gh (Grasshopper 0.9.76)
# plug-ins: Python Interpreter

# ---- group: geometry / opaque surfaces
brep = Brep([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])
wires = BrepWireframe(Brep=brep, Density=-1)
preview = CustomPreview(Geometry=wires, Shader=ColourSwatch(SwatchColor=RGB(0, 0, 0)))
hbsurface = HoneybeePlus_HoneybeeSurface(geo=brep)  # -> report, HBSrf; plug-in component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

# ---- group: geometry / context!
brep_2 = Brep([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])
debrep = DeconstructBrep(Brep=brep_2)  # -> flatten(Faces), Edges, Vertices

# ----
path = FilePath("C:\EnergyPlusV8-6-0\WeatherData\USA_IL_Chicago-OHare.Intl.AP.725300_TMY3.epw")
brep_3 = Brep([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])
wea = HoneybeePlus_Wea(epwFile=path)  # -> wea; plug-in component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
importloc = LadybugPlus_ImportLocation(epwFile=path)  # -> location; plug-in component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
gentestpts = Honeybee_GenerateTestPoints(testGeometry=brep_3, gridSize="1", distBaseSrf=Slider(0.762, range=0..1), moveTestMesh=True)  # -> readMe, simplify(testPoints), simplify(ptsVectors), simplify(facesArea), simplify(mesh); plug-in component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
hbsurface_2 = HoneybeePlus_HoneybeeSurface(geo=debrep.Faces)  # -> report, HBSrf; plug-in component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
wires_2 = BrepWireframe(Brep=brep_3, Density=-1)
panel = Panel("9")
panel_2 = Panel("""room_a
room_b""")
graft = GraftTree(Tree=panel_2, IncludeEmptyLists=True, IncludeNullItems=True)
panel_3 = Panel("21")
climatebased = HoneybeePlus_ClimatebasedSky(wea=wea)  # -> sky; plug-in component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
ciesky = HoneybeePlus_CIEStandardSky(location=importloc, month=6, day=21, type=0)  # -> sky; plug-in component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
analysisgrid = HoneybeePlus_AnalysisGrid(testPoints=gentestpts.testPoints)  # -> analysisGrid; plug-in component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
certainillum = HoneybeePlus_CertainIlluminance()  # -> sky; plug-in component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
panel_4 = Panel(ciesky)
# void brightfunc skyfunc
# 2 skybr skybright.cal
# 0
# 3 2 2.29e+001 3.56e+000
panel_5 = Panel(climatebased)
panel_6 = Panel(certainillum)
flatten = FlattenTree(Tree=analysisgrid, Path="{0}")
panel_7 = Panel(flatten)
gridbasedrecipe = HoneybeePlus_GridBasedRecipe(sky=climatebased, analysisGrids=flatten, analysisType=Slider(0, range=0..100))  # -> analysisRecipe; plug-in component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
gridbasedrecipe_2 = HoneybeePlus_GridBasedRecipe(analysisGrids=flatten)  # -> analysisRecipe; plug-in component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

# ---- group: visualizeGeometry
python = PythonScript()  # -> geo; inputs HBObjs: list
# ---------- python: Python ----------
geo = (hbo.geometry for hbo in HBObjs if hasattr(hbo, 'geometry'))
# ---------- end python ----------

# ----
toggle = BooleanToggle(True)
panel_8 = Panel(gridbasedrecipe)
number_slider = Slider(1360, range=0..10000)
flatten_2 = FlattenTree(Tree=gentestpts.mesh, Path="{0}")
mjoin = MeshJoin(Meshes=flatten_2)
ladybug = Ladybug_Ladybug()  # -> Vviiiiiiiiiizzz; plug-in component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

# ---- group: geometry
panel_9 = Panel("g_material")
panel_10 = Panel("0.55")
brep_4 = Brep([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])
preview_2 = CustomPreview(Geometry=brep_4, Shader=ColourSwatch(SwatchColor=RGBA(65, 114, 255, 72)))

# ----
radglassmaterial = HoneybeePlus_RadianceGlassMaterial(name=panel_9, tVis=panel_10)  # -> material; plug-in component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

# ---- group: geometry (continued)
panel_11 = Panel(radglassmaterial)
hbwinsrf = HoneybeePlus_HoneybeeWindowSurface(geo=brep_4, radMat=radglassmaterial)  # -> report, HBWinSrf; plug-in component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

# ----
data = Data(flatten([hbsurface_2.HBSrf, hbsurface.HBSrf, hbwinsrf.HBWinSrf]))
runradiance = HoneybeePlus_RunRadianceAnalysis(analysisRecipe=gridbasedrecipe_2, HBObjects=data, folder="c:\ladybug", name="workshops", write=toggle, run=toggle)  # -> readMe, legendPar, results; plug-in component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
panel_12 = Panel(runradiance.readMe)
sensor = HoneybeePlus_SensorFromAnalysisGrid(analysisGrid=runradiance.results, index=0)  # -> position, sensor; plug-in component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
panel_13 = Panel(runradiance.results)

# ---- group: hourly values
python_2 = PythonScript(grid=runradiance.results)  # -> readMe, illuminance; inputs hoy: Int32
# ---------- python_2: Python ----------
if _grid:
    from ladybug.dt import DateTime
    
    hoy = _hoy_ or 12
    
    try:
        states = eval(blinds_state_)
    except:
        states = None
    
    if _grid.isResultsPointInTime:
        
        print('Data is only available for {}'.format(DateTime.fromHoy(_grid.hoys[0])))
        illuminance = (p.combinedValueById(_grid.hoys[0], states)[0] for p in _grid)
    else:
        illuminance = (p.combinedValueById(hoy, states)[0] for p in _grid)
# ---------- end python_2 ----------

# ---- group: temporary solution until ladybug[+] is ready!
python_3 = PythonScript(x=runradiance.legendPar)  # -> a, b, c, d
# ---------- python_3: Python ----------
from System.Drawing import Color
if x:
    a = x.domain[0]
    b = x.domain[-1]
    c = 11
    d = (Color.FromArgb(1, c.r, c.g, c.b) for c in x.colors)
# ---------- end python_3 ----------

# ----
item = ListItem(List=sensor.sensor, Index=0, Wrap=True)
python_4 = PythonScript(x=item)  # -> out, a
# ---------- python_4: Python ----------
print x._values
# ---------- end python_4 ----------
legendpar = Ladybug_LegendParameters(lowBound=python_3.a, highBound=python_3.b, numSegments=python_3.c, customColors=flatten(python_3.d))  # -> legendPar; plug-in component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
panel_14 = Panel(python_4.out)
panel_15 = Panel(python_2.illuminance)
flatten_3 = FlattenTree(Tree=python_2.illuminance, Path="{0}")
recolormesh = Ladybug_RecolorMesh(
    analysisResult=flatten_3,
    inputMesh=mjoin,
    legendPar=legendpar,
    analysisTitle="Point-in-time Analysis",
    legendTitle="lux")  # -> readMe, newMesh, newLegend, legendBasePt, meshColors, legendColors; plug-in component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
