# Grasshopper definition 02_daylight_factor_gridbased.gh (Grasshopper 0.9.76)
# plug-ins: Python Interpreter

# Geometry Preparation
number_slider = Slider(0.762, range=0..1)
# Daylight factor simulation - grid-based
# Daylight factor
panel = Panel("1")

# ---- group: opaque surfaces
# Room geometry except for the openings.
# Types and materials will be assigned
# based on normal direction.
# 
# These geometries are under ./scene/opaque
brep = Brep([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])
wires = BrepWireframe(Brep=brep, Density=-1)
preview = CustomPreview(Geometry=wires, Shader=ColourSwatch(SwatchColor=RGB(0, 0, 0)))
hbsurface = HoneybeePlus_HoneybeeSurface(geo=brep)  # -> report, HBSrf; plug-in component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

# ----
# Generate test points
# You can use any other grasshopper
# components to generate these points.
brep_2 = Brep([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])
# Windows are added to the scene
# as normal windows. They will be grouped
# together with room geometries.
# check ./scene/glazing
brep_3 = Brep([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])
radglassmaterial = HoneybeePlus_RadianceGlassMaterial(name="g_material", tVis="0.55")  # -> material; plug-in component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

# ---- group: context!
brep_4 = Brep([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])
debrep = DeconstructBrep(Brep=brep_4)  # -> flatten(Faces), Edges, Vertices

# ----
gentestpts = Honeybee_GenerateTestPoints(testGeometry=brep_2, gridSize=panel, distBaseSrf=number_slider, moveTestMesh=True)  # -> readMe, simplify(testPoints), simplify(ptsVectors), simplify(facesArea), simplify(mesh); plug-in component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
wires_2 = BrepWireframe(Brep=brep_2, Density=-1)
preview_2 = CustomPreview(Geometry=brep_3, Shader=ColourSwatch(SwatchColor=RGBA(65, 114, 255, 72)))
panel_2 = Panel(radglassmaterial)
hbwinsrf = HoneybeePlus_HoneybeeWindowSurface(geo=brep_3, radMat=radglassmaterial)  # -> report, HBWinSrf; plug-in component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
hbsurface_2 = HoneybeePlus_HoneybeeSurface(geo=debrep.Faces)  # -> report, HBSrf; plug-in component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
panel_3 = Panel("""room_a
room_b""")
graft = GraftTree(Tree=panel_3, IncludeEmptyLists=True, IncludeNullItems=True)
# Analysis Grid
analysisgrid = HoneybeePlus_AnalysisGrid(name=graft, testPoints=gentestpts.testPoints)  # -> analysisGrid; plug-in component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
flatten = FlattenTree(Tree=analysisgrid, Path="{0}")
data = Data(flatten([hbsurface_2.HBSrf, hbsurface.HBSrf, hbwinsrf.HBWinSrf]))
# Recipe
dfrecipe = HoneybeePlus_DaylightFactorRecipe(analysisGrids=flatten)  # -> analysisRecipe; plug-in component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
toggle = BooleanToggle(False)
# Run the simulation
panel_4 = Panel(dfrecipe)
# Set write to True to save the files to
# the project folder. This gives you the
# option to check the files before running
# the simulation.
# 
# Once ready also set run to True and the
# component will run the study. The output
# will be the analysis grids or an image
# collection based on the analysis type.
# 
# Results will be stored under ./result
runradiance = HoneybeePlus_RunRadianceAnalysis(analysisRecipe=dfrecipe, HBObjects=data, folder="c:\ladybug", name="sample_files", write=toggle, run=toggle)  # -> report, legendPar, outputs; plug-in component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
# Post process
# Result visualization
# In case of grid-based analysis the result
# is only available for the single hour of
# the simulation.
hourlyvalues = HoneybeePlus_HourlyValues(analysisGrid=runradiance.outputs)  # -> report, values; plug-in component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

# ---- group: temporary solution until ladybug[+] is ready!
python = PythonScript(x=runradiance.legendPar)  # -> a, b, c, d
# ---------- python: Python ----------
from System.Drawing import Color
if x:
    a = x.domain[0]
    b = x.domain[-1]
    c = 11
    d = (Color.FromArgb(1, c.r, c.g, c.b) for c in x.colors)
# ---------- end python ----------

# ----
legendpar = Ladybug_LegendParameters(lowBound=python.a, highBound="20", numSegments=python.c, customColors=flatten(python.d))  # -> legendPar; plug-in component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
flatten_2 = FlattenTree(Tree=hourlyvalues.values, Path="{0}")
flatten_3 = FlattenTree(Tree=gentestpts.mesh, Path="{0}")
mjoin = MeshJoin(Meshes=flatten_3)
recolormesh = Ladybug_RecolorMesh(analysisResult=flatten_2, inputMesh=mjoin, legendPar=legendpar, analysisTitle="daylight factor", legendTitle="%")  # -> readMe, newMesh, newLegend, legendBasePt, meshColors, legendColors; plug-in component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
ladybug = Ladybug_Ladybug()  # -> Vviiiiiiiiiizzz; plug-in component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
