# Grasshopper definition 02_imagebased_analysis.gh (Grasshopper 0.9.76)
# plug-ins: Python Interpreter, Ironbug

path = FilePath("C:\EnergyPlusV8-6-0\WeatherData\USA_IL_Chicago-OHare.Intl.AP.725300_TMY3.epw")
ladybug = Ladybug_Ladybug()  # -> Vviiiiiiiiiizzz; plug-in component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
constructlocation = Ladybug_ConstructLocation(locationName="unknown_Location", latitude="27", longitude=0, timeZone=0, elevation=0)  # -> location; plug-in component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
wea = HoneybeePlus_Wea(epwFile=path)  # -> wea; plug-in component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
panel = Panel("12")
panel_2 = Panel("9")
panel_3 = Panel("21")
number_slider = Slider(23, range=0..100)
radglassmaterial = HoneybeePlus_RadianceGlassMaterial(name="g_material", TVis=".6")  # -> material; plug-in component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
brep = Brep(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)
preview = CustomPreview(Geometry=brep, Shader=ColourSwatch(SwatchColor=RGBA(211, 208, 255, 64)))
wires = BrepWireframe(Brep=brep, Density=-1)
crv = Curve(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)
panel_4 = Panel(radglassmaterial)
climatebased = HoneybeePlus_ClimatebasedSky(wea=wea)  # -> sky; plug-in component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
ciesky = HoneybeePlus_CIEStandardSky(location=constructlocation, month=6, day=21, type=0)  # -> sky; plug-in component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
panel_5 = Panel(ciesky)
end = EndPoints(Curve=crv)  # -> Start, End
radopaquematerial = HoneybeePlus_RadianceOpaqueMaterial(name="wall", reflect=".55", spec=0, rough=0)  # -> material; plug-in component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
hbwinsrf = HoneybeePlus_HoneybeeWindowSurface(geo=brep, name="glass_wall", radMat=radglassmaterial)  # -> report, HBWinSrf; plug-in component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
vec2pt = Vector2Pt(PointA=end.Start, PointB=end.End, Unitize=False)  # -> Vector, Length
vdisex = VectorDisplayEx(Point=end.Start, Vector=vec2pt.Vector, Colour=RGB(0, 0, 0), Width=2)
panel_6 = Panel(radopaquematerial)
view = HoneybeePlus_View(
    name="indoor_view",
    vLocation=end.Start,
    vDirection=vec2pt.Vector,
    vUpVector=Point(0, 0, 1),
    viewType=0,
    hViewAngle="120",
    vViewAngle=45,
    xResolution="800",
    yResolution="800")  # -> view; plug-in component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
panel_7 = Panel(climatebased)
brep_2 = Brep([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])
brep_3 = Brep(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)
brep_4 = Brep([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])
brep_5 = Brep(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)

# ---- group: visualizeGeometry
python = PythonScript(HBObjs=hbwinsrf.HBWinSrf)  # -> geo; inputs HBObjs: list
# ---------- python: Python ----------
geo = (hbo.geometry for hbo in HBObjs if hasattr(hbo, 'geometry'))
# ---------- end python ----------

# ----
wires_2 = BrepWireframe(Brep=brep_4, Density=-1)
debrep = DeconstructBrep(Brep=[brep_2, brep_3])  # -> flatten(Faces), Edges, Vertices
hbwinsrf_2 = HoneybeePlus_HoneybeeWindowSurface()  # -> report, HBWinSrf; plug-in component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
debrep_2 = DeconstructBrep(Brep=brep_5)  # -> Faces, Edges, Vertices
number_slider_2 = Slider(1, range=0..1)
panel_8 = Panel(view)
hbsurface = HoneybeePlus_HoneybeeSurface(geo=debrep.Faces, type=Slider(6, range=0..10))  # -> report, HBSrf; plug-in component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
hbsurface_2 = HoneybeePlus_HoneybeeSurface(geo=debrep_2.Faces)  # -> report, HBSrf; plug-in component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
hbsurface_3 = HoneybeePlus_HoneybeeSurface(geo=brep_4, radMat=radopaquematerial)  # -> report, HBSrf; plug-in component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
imagebasedrecipe = HoneybeePlus_ImageBasedRecipe(sky=ciesky, views=view, analysisType=2)  # -> analysisRecipe; plug-in component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
panel_9 = Panel(hbsurface_3.HBSrf)
panel_10 = Panel(imagebasedrecipe)
hbtorad = HoneybeePlus_WriteHBObjectsToRadiance(hbObjects=hbsurface.HBSrf, folder="c:\ladybug\untitled", filename="context.rad", write=Toggle(True))  # -> radFile; plug-in component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
radscene = HoneybeePlus_RadianceScene(radFiles=hbtorad, copyLocal=True, overwrite=True)  # -> radScene; plug-in component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
number_slider_3 = Slider(2, range=0..10)
toggle = BooleanToggle(False)
data = Data(flatten([hbsurface_3.HBSrf, hbwinsrf.HBWinSrf, hbsurface_2.HBSrf]))
panel_11 = Panel(radscene)
runradiance = HoneybeePlus_RunRadianceAnalysis(
    analysisRecipe=imagebasedrecipe,
    HBObjects=data,
    radScene=radscene,
    folder="c:\ladybug",
    name="workshops",
    write=toggle,
    run=toggle)  # -> readMe, legendPar, results; plug-in component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
panel_12 = Panel(runradiance.readMe)
viewer = ImageViewer(
    ImagePath=runradiance.results,
    ViewportScale=Slider(2, range=0..10),
    DisableClickable=False,
    SaveImgWithCoords=False,
    scale=2)  # -> ImagePath, ColorValues
hdr_tif = Honeybee_ConvertHDRToTIF(adjustExposure=Toggle(False))  # -> TIFFFilePath; plug-in component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
honeybee = Honeybee_Honeybee()  # -> Vviiiiiiiiiizzz; plug-in component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
