# Grasshopper definition 03_annual_daylight_analysis.gh (Grasshopper 0.9.76)
# plug-ins: Python Interpreter

panel = Panel("C:\Users\Mostapha\Documents\helpdesk\izmir\BRA_PA_Serra.dos.Carajas.818600_INMET.epw")
path = FilePath("C:\EnergyPlusV8-6-0\WeatherData\USA_IL_Chicago-OHare.Intl.AP.725300_TMY3.epw")
python = PythonScript()  # -> out, a
# ---------- python: Python ----------
import ladybug
reload(ladybug.location)
# ---------- end python ----------
brep = Brep([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])
panel_2 = Panel("""9
10
11
12
13
14
15""")
number_slider = Slider(2, range=0..10)
wires = BrepWireframe(Brep=brep, Density=-1)
importloc = LadybugPlus_ImportLocation(epwFile=panel)  # -> location; plug-in component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
panel_3 = Panel(path)
importlocation = Ladybug_ImportLocation(epwFile=path)  # -> location; plug-in component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
gentestpts = Honeybee_GenerateTestPoints(testGeometry=brep, gridSize="1", distBaseSrf=Slider(0.762, range=0..1), moveTestMesh=True)  # -> readMe, simplify(testPoints), simplify(ptsVectors), simplify(facesArea), simplify(mesh); plug-in component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
wea = HoneybeePlus_Wea(epwFile=panel)  # -> wea; plug-in component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
doy_hoy = Ladybug_DOY_HOY(days=1, months="6", hours=panel_2)  # -> HOY, DOY, date; plug-in component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

# ---- group: single skylight
brep_2 = Brep(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)

# ---- group: south_skylight
brep_3 = Brep(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)

# ---- group: north_skylight
brep_4 = Brep(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)

# ---- group: opaque surfaces
brep_5 = Brep([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])
wires_2 = BrepWireframe(Brep=brep_5, Density=-1)
preview = CustomPreview(Geometry=wires_2, Shader=ColourSwatch(SwatchColor=RGB(0, 0, 0)))
hbsurface = HoneybeePlus_HoneybeeSurface(geo=brep_5)  # -> report, HBSrf; plug-in component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

# ----
concat = Concatenate(FragmentA="g_material_", FragmentB="0.55")

# ---- group: side window with two states / materials
brep_6 = Brep(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)

# ---- group: side windows. they are static and will be grouped together as window surfaces
brep_7 = Brep([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])

# ----
preview_2 = CustomPreview(Geometry=[brep_4, brep_3, brep_2], Shader=ColourSwatch(SwatchColor=RGBA(221, 128, 94, 72)))

# ---- group: context!
brep_8 = Brep([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])
debrep = DeconstructBrep(Brep=brep_8)  # -> flatten(Faces), Edges, Vertices
hbsurface_2 = HoneybeePlus_HoneybeeSurface(geo=debrep.Faces)  # -> report, HBSrf; plug-in component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

# ----
panel_4 = Panel("""room_a
room_b""")
panel_5 = Panel("""single_skylight
south_skylight
north_skylight""")
pt = Point(gentestpts.testPoints)
radpargridbased = HoneybeePlus_RadianceParametersGridBased(complexity=0, recipeType=Slider(1, range=0..1))  # -> report, radPar, vmtxPar, dmtxPar, smtxPar; plug-in component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
radglassmaterial = HoneybeePlus_RadianceGlassMaterial(name=concat, tVis="0.55")  # -> material; plug-in component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
merge = Merge(Data1=brep_2, Data2=brep_3, Data3=brep_4)
python_2 = PythonScript()  # -> out, a
# ---------- python_2: Python ----------
import honeybee
reload(honeybee.radiance.analysispoint)
reload(honeybee.radiance.analysisgrid)
# ---------- end python_2 ----------
preview_3 = CustomPreview(Geometry=brep_7, Shader=ColourSwatch(SwatchColor=RGBA(121, 230, 94, 72)))
hbsurface_3 = HoneybeePlus_HoneybeeSurface()  # -> report, HBSrf; plug-in component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
graft = GraftTree(Tree=panel_4, IncludeEmptyLists=True, IncludeNullItems=True)
pt_2 = Point(Point(0, -64, 0))
analysisgrid = HoneybeePlus_AnalysisGrid(testPoints=pt)  # -> analysisGrid; plug-in component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
panel_6 = Panel(radpargridbased.dmtxPar)
hbwinsrf = HoneybeePlus_HoneybeeWindowSurface(geo=merge, names=panel_5)  # -> report, HBWinSrf; plug-in component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
hbwinsrf_2 = HoneybeePlus_HoneybeeWindowSurface(geo=brep_6, names="north_facing", radMat=radglassmaterial)  # -> report, HBWinSrf; plug-in component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
hbwinsrf_3 = HoneybeePlus_HoneybeeWindowSurface(geo=brep_7)  # -> report, HBWinSrf; plug-in component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
skyvector = HoneybeePlus_SkyVector(north=0, wea=wea, month=6, day=21, hour="10")  # -> skyVec; plug-in component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
skymatrix = HoneybeePlus_SkyMatrix(north=0, wea=wea, density=1)  # -> skymtx; plug-in component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
radpargridbased_2 = HoneybeePlus_RadianceParametersGridBased(complexity=0, recipeType=Slider(1, range=0..1))  # -> report, radPar, vmtxPar, dmtxPar, smtxPar; plug-in component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
radparimagebased = HoneybeePlus_RadianceParametersImageBased(complexity=0)  # -> report, radPar, vmtxPar, dmtxPar, smtxPar; plug-in component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
flatten = FlattenTree(Tree=analysisgrid, Path="{0}")
importepw = LadybugPlus_ImportEPW(epwFile=panel)  # -> report, location, dryBulbTemperature, dewPointTemperature, relativeHumidity, windSpeed, windDirection, directNormalRadiation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; plug-in component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
number_slider_2 = Slider(1, range=0..1)
panel_7 = Panel(radpargridbased_2.dmtxPar)
toggle = BooleanToggle(False)
python_3 = PythonScript(x=skymatrix)  # -> out, a
# ---------- python_3: Python ----------
a = dir(x)
# ---------- end python_3 ----------
climatebased = HoneybeePlus_ClimatebasedSky(wea=wea, month="1", day="1", hour="9.5")  # -> sky; plug-in component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
panel_8 = Panel(python_3.a)
panel_9 = Panel(importepw.location)
data = Data(flatten([hbsurface.HBSrf, hbsurface_2.HBSrf, hbwinsrf_3.HBWinSrf, hbwinsrf_2.HBWinSrf, hbwinsrf.HBWinSrf]))
radiationrecipe = HoneybeePlus_AnnualRadiationRecipe(skymtx=skymatrix, analysisGrids=flatten, dmtxPar=radpargridbased_2.dmtxPar, reuseDmtx=Toggle(False))  # -> analysisRecipe; plug-in component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
dcoeffgbrecipe = HoneybeePlus_DCGridBasedDaylightRecipe(skymtx=skymatrix, analysisGrids=flatten, analysisType=0, dmtxPar=radpargridbased_2.dmtxPar, reuseDmtx=Toggle(True))  # -> analysisRecipe; plug-in component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
annualdlrecipe = HoneybeePlus_AnnualDaylightRecipe(skymtx=skymatrix, analysisGrids=flatten, analysisType=0, dmtxPar=radpargridbased_2.dmtxPar, reuseDmtx=True)  # -> analysisRecipe; plug-in component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
gridbasedrecipe = HoneybeePlus_GridBasedRecipe(sky=climatebased, analysisGrids=flatten, analysisType=Slider(1, range=0..1))  # -> analysisRecipe; plug-in component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
python_4 = PythonScript(x=dcoeffgbrecipe)  # -> out, a
# ---------- python_4: Python ----------
print x.simulationType
print x.skyMatrix.skyType
# ---------- end python_4 ----------
python_5 = PythonScript(x=radiationrecipe)  # -> out, a; same code as python_4
panel_10 = Panel(python_5.out)
panel_11 = Panel(python_4.out)
toggle_2 = BooleanToggle(True)
number_slider_3 = Slider(15, range=9..18)
number_slider_4 = Slider(2, range=0..10)
runradiance = HoneybeePlus_RunRadianceAnalysis(analysisRecipe=annualdlrecipe, HBObjects=data, folder="c:\ladybug", name="validation", write=toggle_2, run=toggle_2)  # -> report, legendPar, outputs; plug-in component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
doy_hoy_2 = Ladybug_DOY_HOY(days=1, months=number_slider_4, hours=number_slider_3)  # -> HOY, DOY, date; plug-in component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
sensor = HoneybeePlus_SensorFromAnalysisGrid(analysisGrid=runradiance.outputs, index=0)  # -> position, sensor; plug-in component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
maxvalue = HoneybeePlus_MaximumValue(analysisGrid=runradiance.outputs)  # -> values; plug-in component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
ase = HoneybeePlus_AnnualSolarExposure(threshold=1000, targetHrs=250, targetArea=10)  # -> report, success, ASE, perArea, prblmPts, prblmHrs; plug-in component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

# ---- group: hourly values
hourlyvalues = HoneybeePlus_HourlyValues(analysisGrid=runradiance.outputs, hoy=doy_hoy_2.HOY)  # -> report, values; plug-in component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

# ----
annualmetrics = HoneybeePlus_AnnualDaylightMetrics()  # -> report, DA, CDA, UDI, UDILess, UDIMore; plug-in component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
cumvalue = HoneybeePlus_CumulativeValue(analysisGrid=runradiance.outputs)  # -> report, values; plug-in component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
sda = HoneybeePlus_SpatialDaylightAutonomy(threshold=300, targetArea=55)  # -> report, sDA, prblmHrs; plug-in component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
senhourlyvalues = HoneybeePlus_SensorHourlyValues(sensor=sensor.sensor)  # -> report, values; plug-in component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
panel_12 = Panel(cumvalue.report)
panel_13 = Panel(hourlyvalues.values)
panel_14 = Panel(senhourlyvalues.values)
data_2 = Data()
num = Number(Tree({0;0;0}: [63.77272727, 59.95454545, 63.22727273, 75.45454545, 93.77272727, 98.5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], {0;0;1}: [70.81818182, 52.59090909, 41.27272727, 37.36363636, 50.22727273, 82.09090909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]))
number_slider_5 = Slider(100, range=0..100)
dynblindschd = HoneybeePlus_DynamicBlindsSchedule()  # -> report, blindStates, blindStIndex, illumTotal, illumDirect, success; plug-in component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
num_2 = Number(Tree({0;0;0}: [63.77272727, 59.95454545, 63.22727273, 75.45454545, 93.77272727, 98.5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], {0;0;1}: [70.81818182, 52.59090909, 41.27272727, 37.36363636, 50.22727273, 82.09090909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]))
item = ListItem(Index=0, Wrap=True)
item_2 = ListItem(List=data_2, Index=0, Wrap=True)
sensor_2 = HoneybeePlus_SensorFromAnalysisGrid(analysisGrid=data_2, index=0)  # -> position, sensor; plug-in component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
python_6 = PythonScript(x=item_2)  # -> out, a
# ---------- python_6: Python ----------
a = x[0]
# ---------- end python_6 ----------
panel_15 = Panel(dynblindschd.report)
python_7 = PythonScript(x=python_6.a)  # -> out, a
# ---------- python_7: Python ----------
a = x.values(None, 'scene', 'default')
# ---------- end python_7 ----------
panel_16 = Panel("""(0,)
(-1,)""")
item_3 = ListItem(List=sensor_2.sensor, Index=Slider(0, range=0..1), Wrap=True)
larger = LargerThan(FirstNumber=python_7.a, SecondNumber=300)  # -> LargerThan, OrEqualTo
ma = MassAddition(Input=larger.OrEqualTo)  # -> Result, PartialResults
panel_17 = Panel(python_7.a)
lng = ListLength(List=python_7.a)
division = Division(A=ma.Result, B=lng)
panel_18 = Panel(division)
occschduleweek = HoneybeePlus_OccupancyScheduleFromWeek(defValue=1)  # -> schedule, values; plug-in component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
number_slider_6 = Slider(55, range=0..100)
number_slider_7 = Slider(50, range=0..100)
panel_19 = Panel("(-1, -1, -1, -1, 0)")
occschdule = HoneybeePlus_OccupancySchedule()  # -> schedule; plug-in component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
ase_2 = HoneybeePlus_AnnualSolarExposure(analysisGrid=data_2, threshold=1000, targetHrs=250, targetArea=10)  # -> report, success, ASE, perArea, prblmPts, prblmHrs; plug-in component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
sda_2 = HoneybeePlus_SpatialDaylightAutonomy(analysisGrid=data_2, threshold=300, targetArea="90")  # -> report, sDA, prblmHrs; plug-in component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
annualmetrics_2 = HoneybeePlus_AnnualDaylightMetrics(analysisGrid=data_2, blindStates=dynblindschd.blindStates, occSchedule=occschduleweek.schedule)  # -> report, DA, CDA, UDI, UDILess, UDIMore; plug-in component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
lng_2 = ListLength(List=sda_2.prblmHrs)
number_slider_8 = Slider(2, range=1..2)
number_slider_9 = Slider(0, range=0..10)
item_4 = ListItem(List=sda_2.prblmHrs, Index=0, Wrap=True)
division_2 = Division(A=lng_2, B="22")
panel_20 = Panel(item_4)
maxvalue_2 = HoneybeePlus_MaximumValue(analysisGrid=data_2)  # -> values; plug-in component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
cumvalue_2 = HoneybeePlus_CumulativeValue(analysisGrid=data_2)  # -> report, values; plug-in component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
ladybug = Ladybug_Ladybug()  # -> Vviiiiiiiiiizzz; plug-in component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
senhourlyvalues_2 = HoneybeePlus_SensorHourlyValues(sensor=item_3, mode=Slider(2, range=0..2))  # -> report, values; plug-in component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
panel_21 = Panel("250")

# ---- group: temporary solution until ladybug[+] is ready!
python_8 = PythonScript(x=runradiance.legendPar)  # -> a, b, c, d
# ---------- python_8: Python ----------
from System.Drawing import Color
if x:
    a = x.domain[0]
    b = x.domain[-1]
    c = 11
    d = (Color.FromArgb(1, c.r, c.g, c.b) for c in x.colors)
# ---------- end python_8 ----------

# ----
ase_3 = HoneybeePlus_AnnualSolarExposure(threshold=1000, targetHrs=250, targetArea=10)  # -> report, success, perArea, prblmPts, prblmHrs; plug-in component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
panel_22 = Panel(maxvalue_2)
sunpath = Ladybug_SunPath(
    location=importlocation,
    hour=number_slider_3,
    day=21,
    month=number_slider_4,
    timeStep=1,
    sunPathScale="0.25",
    dailyOrAnnualSunPath=True)  # -> readMe, sunVectors, sunAltitudes, sunAzimuths, port, sunSpheresMesh, sunPathCrvs, compassCrvs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; plug-in component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
legendpar = Ladybug_LegendParameters(lowBound=python_8.a, highBound=Slider(100, range=0..100), numSegments=python_8.c, customColors=flatten(python_8.d))  # -> legendPar; plug-in component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
mjoin = MeshJoin(Meshes=flatten(gentestpts.mesh))
flatten_2 = FlattenTree(Tree=annualmetrics.UDI, Path="{0}")
panel_23 = Panel(sunpath.sunAltitudes)
recolormesh = Ladybug_RecolorMesh(
    analysisResult=flatten_2,
    inputMesh=mjoin,
    legendPar=legendpar,
    analysisTitle="Annual Solar Exposure",
    legendTitle="hour")  # -> readMe, newMesh, newLegend, legendBasePt, meshColors, legendColors; plug-in component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
ladybug_2 = Ladybug_Ladybug()  # -> Vviiiiiiiiiizzz; plug-in component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
