# Grasshopper definition 04_annual_daylight_gridbased.gh (Grasshopper 1.0.7)

# ---- group: south_skylight
brep = Brep(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)

# ---- group: single skylight
brep_2 = Brep(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)

# ---- group: north_skylight
brep_3 = Brep(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)

# ----
concat = Concatenate(FragmentA="g_material_", FragmentB="0.55")
preview = CustomPreview(Geometry=[brep_3, brep, brep_2], Shader=ColourSwatch(SwatchColor=RGBA(221, 128, 94, 72)))

# ---- group: side window
brep_4 = Brep(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)

# ---- group: side windows. they are static and will be grouped together as window surfaces
# Windows
# In this example windows are grouped based
# on their material type. Note that you can't use
# windowgroups with the annual recipe.
# 
# Glazing geometries will be saved under ./scene/glazing
brep_5 = Brep([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])

# ----
radglassmat = HoneybeePlus_RadianceGlassMaterial(name=concat, t_vis="0.55")  # -> material; plug-in component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
merge = Merge(Data1=brep_2, Data2=brep, Data3=brep_3)
preview_2 = CustomPreview(Geometry=brep_5, Shader=ColourSwatch(SwatchColor=RGBA(121, 230, 94, 72)))
hbwinsrf = HoneybeePlus_HoneybeeWindowSurface(geo=brep_5)  # -> report, HB_win_srf; plug-in component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
concat_2 = Concatenate(FragmentA="g_material_", FragmentB="0.45")

# ---- group: context!
# Add context surfaces.
# These geometries are under ./scene/opaque
brep_6 = Brep([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])
debrep = DeconstructBrep(Brep=brep_6)  # -> flatten(Faces), Edges, Vertices
hbsurface = HoneybeePlus_HoneybeeSurface(geo=debrep.Faces)  # -> report, HB_srf; plug-in component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

# ---- group: opaque surfaces
brep_7 = Brep([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])
wires = BrepWireframe(Brep=brep_7, Density=-1)
preview_3 = CustomPreview(Geometry=wires, Shader=ColourSwatch(SwatchColor=RGB(0, 0, 0)))
# Geometry Preparation
# Room geometry except for the openings.
# Types and materials will be assigned
# based on normal direction.
# 
# These geometries are under ./scene/opaque
hbsurface_2 = HoneybeePlus_HoneybeeSurface(geo=brep_7)  # -> report, HB_srf; plug-in component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

# ----
hbwinsrf_2 = HoneybeePlus_HoneybeeWindowSurface(geo=brep_4, names="north_facing", rad_mat=radglassmat)  # -> report, HB_win_srf; plug-in component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
# Annual daylight simulation; grid-based
# This sample file shows how to set up a grid-based annual daylight analysis.
# 
# NOTE: Annual daylight recipe is an special type of daylight coefficient recipe.
# The main difference is that in annual daylight recipe the hourly results are not
# loaded at the end of the analysis which makes it a better choice for cases with
# 1000s of test points.
txt = Text("https://www.energyplus.net/weather-download/north_and_central_america_wmo_region_4/USA/IL/USA_IL_Chicago-OHare.725300_TMY2/all")
radglassmat_2 = HoneybeePlus_RadianceGlassMaterial(name=concat_2, t_vis="0.45")  # -> material; plug-in component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
# Generate test points
# You can use any other grasshopper
# components to generate these points.
panel = Panel("1")
downloadweather = LadybugPlus_DownloadWeather(weather_URL=txt)  # -> epw_file, stat_file, ddy_file; plug-in component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
brep_8 = Brep([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])
hbwinsrf_3 = HoneybeePlus_HoneybeeWindowSurface(geo=merge, rad_mat=radglassmat_2)  # -> report, HB_win_srf; plug-in component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
gentestpts = Honeybee_GenerateTestPoints(testGeometry=brep_8, gridSize=panel, distBaseSrf=Slider(0.762, range=0..1), moveTestMesh=True)  # -> readMe, simplify(testPoints), simplify(ptsVectors), simplify(facesArea), simplify(mesh); plug-in component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
wires_2 = BrepWireframe(Brep=brep_8, Density=-1)
path = FilePath(downloadweather.epw_file)
wea = HoneybeePlus_WEAFromEPW(epw_file=path)  # -> wea; plug-in component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
pt = Point(gentestpts.testPoints)
panel_2 = Panel("""9
10
11
12
13
14
15""")
doy_hoy = Ladybug_DOY_HOY(days=1, months="6", hours=panel_2)  # -> HOY, DOY, date; plug-in component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
skyvector = HoneybeePlus_SkyVector(north=0, wea=wea, month=6, day=21, hour="10")  # -> sky_vec; plug-in component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
panel_3 = Panel("""room_a
room_b""")
graft = GraftTree(Tree=panel_3, IncludeEmptyLists=True, IncludeNullItems=True)
# Sky Matrix
# You can use hoys input for subannual simulation.
# Sky will be created under ./sky folder.
skymatrix = HoneybeePlus_SkyMatrix(north=0, wea=wea, density=1)  # -> skymtx; plug-in component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
# Analysis Grid
analysisgrid = HoneybeePlus_AnalysisGrid(name=graft, test_points=gentestpts.testPoints, pts_vectors=gentestpts.ptsVectors)  # -> analysis_grid; plug-in component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
data = Data(flatten([hbsurface_2.HB_srf, hbsurface.HB_srf, hbwinsrf.HB_win_srf, hbwinsrf_2.HB_win_srf, hbwinsrf_3.HB_win_srf]))
flatten = FlattenTree(Tree=analysisgrid, Path="{0}")
# Recipe
annualdlrecipe = HoneybeePlus_AnnualDaylightRecipe(skymtx=skymatrix, analysis_grids=flatten, analysis_type=0, reuse_dmtx=False)  # -> analysis_recipe; plug-in component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
panel_4 = Panel(annualdlrecipe)
panel_5 = Panel("15")
# Run the simulation
# Set write to True to save the files to
# the project folder. This gives you the
# option to check the files before running
# the simulation.
# 
# Once ready also set run to True and the
# component will run the study. The output
# will be the analysis grids or an image
# collection based on the analysis type.
# 
# Results will be stored under ./result
runradiance = HoneybeePlus_RunRadianceAnalysis(
    analysis_recipe=annualdlrecipe,
    HB_objects=data,
    folder="c:\ladybug",
    name="honeybee_005",
    write=Toggle(False),
    run=Toggle(False))  # -> report, legend_par, outputs; plug-in component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
panel_6 = Panel("""8
18""")
# IES LM-83-12 analysis hours
panel_7 = Panel("-1")
occscheduleweek = HoneybeePlus_OccupancyScheduleFromWeek(occ_hours=panel_6, off_hours=panel_7, weekend="-1", def_value=1)  # -> schedule, values; plug-in component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
panel_8 = Panel(occscheduleweek.schedule)
# NOTE:
# The blinds are not considered
# in this calculation unless you
# provide them using blindStates_.
sda = HoneybeePlus_SpatialDaylightAutonomy(analysis_grid=runradiance.outputs, occ_schedule=occscheduleweek.schedule, threshold=300, target_DA=50)  # -> report, sDA, DA, prblm_pts; plug-in component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
# Result visualization
# Annual metrics
# Use any of the three components to calculate
# sDA, ASE, DA, CDA, UDI, etc.
ase = HoneybeePlus_AnnualSunlightExposure(analysis_grid=runradiance.outputs, threshold=1000, target_hrs=250, target_area=10)  # -> report, success, ASE, per_area, prblm_pts, prblm_hrs, legend_par; plug-in component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
annualmetrics = HoneybeePlus_AnnualDaylightMetrics(analysis_grid=runradiance.outputs)  # -> report, DA, CDA, UDI, UDI_less, UDI_more, legend_par; plug-in component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
panel_9 = Panel(annualmetrics.DA)
panel_10 = Panel(sda.sDA)
item = ListItem(List=ase.legend_par, Index=0, Wrap=True)

# ---- group: temporary solution until ladybug[+] is ready!
python = PythonScript(x=item)  # -> a, b, c, d
# ---------- python: Python ----------
from System.Drawing import Color
if x:
    a = x.min
    b = x.max
    c = 11
    d = (Color.FromArgb(1, c.r, c.g, c.b) for c in x.colors)
# ---------- end python ----------

# ----
legendpar = Ladybug_LegendParameters(lowBound=python.a, highBound=python.b, numSegments=python.c, customColors=flatten(python.d))  # -> legendPar; plug-in component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
mjoin = MeshJoin(Meshes=flatten(gentestpts.mesh))
flatten_2 = FlattenTree(Tree=ase.ASE, Path="{0}")
recolormesh = Ladybug_RecolorMesh(analysisResult=flatten_2, inputMesh=mjoin, legendPar=legendpar, analysisTitle="ASE", legendTitle="hours")  # -> readMe, newMesh, newLegend, legendBasePt, meshColors, legendColors; plug-in component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
ladybug = Ladybug_Ladybug()  # -> Vviiiiiiiiiizzz; plug-in component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
