# Grasshopper definition 06_daylight_coefficient_gridbased.gh (Grasshopper 1.0.7)

# ---- group: south_skylight
brep = Brep(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)

# ---- group: single skylight
brep_2 = Brep(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)

# ---- group: north_skylight
brep_3 = Brep(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)

# ----
concat = Concatenate(FragmentA="g_material_", FragmentB="0.25")
radglassmat = HoneybeePlus_RadianceGlassMaterial(name=concat, t_vis="0.25")  # -> material; plug-in component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

# ---- group: side windows. they are static and will be grouped together as window surfaces
# Window Groups
# This is an example to show all the
# different possibilities of using window
# groups in honeybee. You won't probably
# use all these cases in a single file together.
# 
# Window groups are under ./scene/wgroup
brep_4 = Brep([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])

# ----
concat_2 = Concatenate(FragmentA="g_material_", FragmentB="0.55")
preview = CustomPreview(Geometry=[brep_3, brep, brep_2], Shader=ColourSwatch(SwatchColor=RGBA(221, 128, 94, 72)))
# This is an example of creating static
# windowgroups. We are using datatree
# structure to create 3 window groups for each
# skylight. This will be helpful to add/remove
# the contribution of each of them in result
# visualization.
# 
# Use WindowGroup component to create
# static or dynamic window groups. In case
# of multi-phase recipes windows in each
# windowgroup should have the same direction.
# 
# Each window group will be written to  ./scene/wgroup
panel = Panel("""single_skylight
south_skylight
north_skylight""")
merge = Merge(Data1=brep_2, Data2=brep, Data3=brep_3)
preview_2 = CustomPreview(Geometry=brep_4, Shader=ColourSwatch(SwatchColor=RGBA(121, 230, 94, 72)))

# ---- group: side window with two states / materials
brep_5 = Brep(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)

# ----
radglassmat_2 = HoneybeePlus_RadianceGlassMaterial(name=concat_2, t_vis="0.55")  # -> material; plug-in component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
wingroupstate = HoneybeePlus_WindowGroupState(name="dark_glass_0.25", rad_mat=radglassmat)  # -> report, state; plug-in component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
# Use FenSurface component to create
# static windows. These windows are grouped
# together as part of the scene.
# 
# These windows are written to  ./scene/glazing
hbwinsrf = HoneybeePlus_HoneybeeWindowSurface(geo=brep_4)  # -> report, HB_win_srf; plug-in component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

# ---- group: context!
# Add context surfaces.
# These geometries are under ./scene/opaque
brep_6 = Brep([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])
debrep = DeconstructBrep(Brep=brep_6)  # -> flatten(Faces), Edges, Vertices
hbsurface = HoneybeePlus_HoneybeeSurface(geo=debrep.Faces)  # -> report, HB_srf; plug-in component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

# ---- group: opaque surfaces
brep_7 = Brep([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])
wires = BrepWireframe(Brep=brep_7, Density=-1)
preview_3 = CustomPreview(Geometry=wires, Shader=ColourSwatch(SwatchColor=RGB(0, 0, 0)))
# Geometry Preparation
# Room geometry except for the openings.
# Types and materials will be assigned
# based on normal direction.
# 
# These geometries are under ./scene/opaque
hbsurface_2 = HoneybeePlus_HoneybeeSurface(geo=brep_7)  # -> report, HB_srf; plug-in component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

# ----
graft = GraftTree(Tree=merge, IncludeEmptyLists=True, IncludeNullItems=True)
graft_2 = GraftTree(Tree=panel, IncludeEmptyLists=True, IncludeNullItems=True)
# Daylight coefficient grid-based simulation
# A sample file on how to use daylight coefficient recipe. Daylight coefficient recipe in honeybee
# is implemented using radiance utilities and doesn't use Daysim.
txt = Text("https://www.energyplus.net/weather-download/north_and_central_america_wmo_region_4/USA/IL/USA_IL_Chicago-OHare.725300_TMY2/all")
hbwingroup = HoneybeePlus_HoneybeeWindowGroup(geo=graft, name=graft_2)  # -> report, HB_win_group; plug-in component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
# Generate test points
# You can use any other grasshopper
# components to generate these points.
panel_2 = Panel("1")
downloadweather = LadybugPlus_DownloadWeather(weather_URL=txt)  # -> epw_file, stat_file, ddy_file; plug-in component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
# Use WindowGroup component to create
# static or dynamic window groups. In case
# of multi-phase recipes windows in each
# windowgroup should have the same direction.
# 
# Each window group will be written to  ./scene/wgroup
hbwingroup_2 = HoneybeePlus_HoneybeeWindowGroup(geo=brep_5, name="north_facing", rad_mat=radglassmat_2, states=wingroupstate.state)  # -> report, HB_win_group; plug-in component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
brep_8 = Brep([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])
panel_3 = Panel(hbwingroup.HB_win_group)
gentestpts = Honeybee_GenerateTestPoints(testGeometry=brep_8, gridSize=panel_2, distBaseSrf=Slider(0.762, range=0..1), moveTestMesh=True)  # -> readMe, simplify(testPoints), simplify(ptsVectors), simplify(facesArea), simplify(mesh); plug-in component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
wires_2 = BrepWireframe(Brep=brep_8, Density=-1)
path = FilePath(downloadweather.epw_file)
wea = HoneybeePlus_WEAFromEPW(epw_file=path)  # -> wea; plug-in component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
pt = Point(gentestpts.testPoints)
panel_4 = Panel("""9
10
11
12
13
14
15""")
hoy = LadybugPlus_CalculateHOY(month="6", day=21, hour=panel_4, minute=0)  # -> hoy, doy, date; plug-in component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
skyvector = HoneybeePlus_SkyVector(north=0, wea=wea, month=6, day=21, hour="10")  # -> sky_vec; plug-in component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
panel_5 = Panel("""room_a
room_b""")
graft_3 = GraftTree(Tree=panel_5, IncludeEmptyLists=True, IncludeNullItems=True)
# Sky Matrix
# You can use hoys input for subannual simulation.
# Sky will be created under ./sky folder.
skymatrix = HoneybeePlus_SkyMatrix(north=0, wea=wea, density=1)  # -> skymtx; plug-in component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
# Analysis Grid
analysisgrid = HoneybeePlus_AnalysisGrid(name=graft_3, test_points=gentestpts.testPoints, pts_vectors=gentestpts.ptsVectors)  # -> analysis_grid; plug-in component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
data = Data(flatten([hbsurface_2.HB_srf, hbsurface.HB_srf, hbwinsrf.HB_win_srf, hbwingroup_2.HB_win_group, hbwingroup.HB_win_group]))
flatten = FlattenTree(Tree=analysisgrid, Path="{0}")
# Recipe
dcoeffgbrecipe = HoneybeePlus_DCGridBasedDaylightRecipe(skymtx=skymatrix, analysis_grids=flatten, analysis_type=0, reuse_dmtx=False)  # -> analysis_recipe; plug-in component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
panel_6 = Panel(dcoeffgbrecipe)
# Run the simulation
# Set write to True to save the files to
# the project folder. This gives you the
# option to check the files before running
# the simulation.
# 
# Once ready also set run to True and the
# component will run the study. The output
# will be the analysis grids or an image
# collection based on the analysis type.
# 
# Results will be stored under ./result
runradiance = HoneybeePlus_RunRadianceAnalysis(
    analysis_recipe=dcoeffgbrecipe,
    HB_objects=data,
    folder="c:\ladybug",
    name="honeybee_005",
    write=Toggle(False),
    run=Toggle(False))  # -> report, legend_par, outputs; plug-in component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
panel_7 = Panel(runradiance.report)

# ---- group: what will happen by removing skylights
# Result visualization
# Annual metrics - Dynamic blinds
# We keep it simple in this example and just
# try different combinations of the blind states
# and study the effect on the annual metrics for
# an advanced dynamic blinds example
# see the 3-phase sample file.
panel_8 = Panel("0, 1, -1, -1, -1")
dup = DuplicateData(Data=panel_8, Number="8760", Order=True)

# ----
occscheduleweek = HoneybeePlus_OccupancyScheduleFromWeek(def_value=1)  # -> schedule, values; plug-in component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
ase = HoneybeePlus_AnnualSunlightExposure(analysis_grid=runradiance.outputs, threshold=1000, target_hrs=250, target_area=10)  # -> report, success, ASE, per_area, prblm_pts, prblm_hrs, legend_par; plug-in component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
annualmetrics = HoneybeePlus_AnnualDaylightMetrics()  # -> report, DA, CDA, UDI, UDI_less, UDI_more, legend_par; plug-in component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
sda = HoneybeePlus_SpatialDaylightAutonomy(threshold=300, target_DA=50)  # -> report, sDA, DA, prblm_pts; plug-in component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
item = ListItem(List=ase.legend_par, Index=0, Wrap=True)

# ---- group: temporary solution until ladybug[+] is ready!
python = PythonScript(x=item)  # -> a, b, c, d
# ---------- python: Python ----------
from System.Drawing import Color
if x:
    a = x.min
    b = x.max
    c = 11
    d = (Color.FromArgb(1, c.r, c.g, c.b) for c in x.colors)
# ---------- end python ----------

# ----
legendpar = Ladybug_LegendParameters(lowBound=python.a, highBound=python.b, numSegments=python.c, customColors=flatten(python.d))  # -> legendPar; plug-in component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
mjoin = MeshJoin(Meshes=flatten(gentestpts.mesh))
flatten_2 = FlattenTree(Tree=ase.ASE, Path="{0}")
recolormesh = Ladybug_RecolorMesh(analysisResult=flatten_2, inputMesh=mjoin, legendPar=legendpar, analysisTitle="ASE", legendTitle="hours")  # -> readMe, newMesh, newLegend, legendBasePt, meshColors, legendColors; plug-in component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
ladybug = Ladybug_Ladybug()  # -> Vviiiiiiiiiizzz; plug-in component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
