# Grasshopper definition 07_daylight_coefficient_imagebased.gh (Grasshopper 0.9.76)
# plug-ins: Python Interpreter, Human, Ironbug

# ---- group: Skylights will have only one state but we create a separate window group for each so we can study the effect of removing / adding each of them / single skylight
brep = Brep(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)

# ---- group: Skylights will have only one state but we create a separate window group for each so we can study the effect of removing / adding each of them / south_skylight
brep_2 = Brep(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)

# ---- group: Skylights will have only one state but we create a separate window group for each so we can study the effect of removing / adding each of them / north_skylight
brep_3 = Brep(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)

# ----
concat = Concatenate(FragmentA="g_material_", FragmentB="0.25")
path = FilePath("C:\EnergyPlusV8-6-0\WeatherData\USA_IL_Chicago-OHare.Intl.AP.725300_TMY3.epw")
concat_2 = Concatenate(FragmentA="g_material_", FragmentB="0.55")
preview = CustomPreview(Geometry=[brep_3, brep_2, brep], Shader=ColourSwatch(SwatchColor=RGBA(221, 128, 94, 72)))
radglassmaterial = HoneybeePlus_RadianceGlassMaterial(name=concat, tVis="0.25")  # -> material; plug-in component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
panel = Panel("""single_skylight
south_skylight
north_skylight""")
panel_2 = Panel("""9
10
11
12
13
14
15""")
merge = Merge(Data1=brep)
panel_3 = Panel(path)

# ---- group: side window with two states / materials
brep_4 = Brep(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)

# ---- group: side windows. they are static and will be grouped together as window surfaces
brep_5 = Brep([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])

# ----
radglassmaterial_2 = HoneybeePlus_RadianceGlassMaterial(name=concat_2, tVis="0.55")  # -> material; plug-in component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

# ---- group: context!
brep_6 = Brep([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])
debrep = DeconstructBrep(Brep=brep_6)  # -> flatten(Faces), Edges, Vertices
hbsurface = HoneybeePlus_HoneybeeSurface(geo=debrep.Faces)  # -> report, HBSrf; plug-in component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

# ----
wea = HoneybeePlus_Wea(epwFile=path)  # -> wea; plug-in component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
doy_hoy = Ladybug_DOY_HOY(days=1, months="6", hours=panel_2)  # -> HOY, DOY, date; plug-in component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
item = ListItem(List=panel, Index=0, Wrap=True)
pt = Point(Point(1, 1, 2))
pt_2 = Point(Point(2.761757981, 3.184085208, 2.438065029))
hbwingroupstate = HoneybeePlus_WindowGroupState(name="dark_glass_0.25", radMat=radglassmaterial)  # -> report, state; plug-in component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
list = ItemSelector(brep_5, {"Trimmed Surface", "Trimmed Surface", "Trimmed Surface"}, selected="Trimmed Surface")
graft = GraftTree(Tree=merge, IncludeEmptyLists=True, IncludeNullItems=True)
preview_2 = CustomPreview(Geometry=brep_5, Shader=ColourSwatch(SwatchColor=RGBA(121, 230, 94, 72)))
graft_2 = GraftTree(Tree=item, IncludeEmptyLists=True, IncludeNullItems=True)
ln = Line(StartPoint=pt, EndPoint=pt_2)
vec = Vector(ln)
hbwingroup = HoneybeePlus_HoneybeeWindowGroup(geo=graft, name=graft_2)  # -> report, HBWinGroup; plug-in component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
hbwingroup_2 = HoneybeePlus_HoneybeeWindowGroup(geo=brep_4, name="north_facing", radMat=radglassmaterial_2)  # -> report, HBWinGroup; plug-in component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
hbwinsrf = HoneybeePlus_HoneybeeWindowSurface(geo=[list, brep])  # -> report, HBWinSrf; plug-in component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
view = HoneybeePlus_View(
    name="inside_NE",
    vLocation=pt,
    vDirection=vec,
    vUpVector=Point(0, 0, 1),
    viewType=0,
    hViewAngle="60",
    vViewAngle=45,
    xResolution="400",
    yResolution="400")  # -> view; plug-in component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
panel_4 = Panel(hbwingroup.HBWinGroup)
skymatrix = HoneybeePlus_SkyMatrix(north=0, wea=wea, density=1, hoys=doy_hoy.HOY)  # -> skymtx; plug-in component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
skyvector = HoneybeePlus_SkyVector(north=0, wea=wea, month=6, day=21, hour="10")  # -> skyVec; plug-in component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
ladybug = Ladybug_Ladybug()  # -> Vviiiiiiiiiizzz; plug-in component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
honeybee = Honeybee_Honeybee()  # -> Vviiiiiiiiiizzz; plug-in component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
dcoeffgbrecipe = HoneybeePlus_DCImageBasedDaylightRecipe(skymtx=skymatrix, views=view, analysisType=2, reuseDmtx=Toggle(True))  # -> analysisRecipe; plug-in component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
toggle = BooleanToggle(False)
panel_5 = Panel("(0, -1)")
item_2 = ListItem(List=doy_hoy.HOY, Index=Slider(5, range=0..7), Wrap=True)

# ---- group: opaque surfaces
brep_7 = Brep([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])
wires = BrepWireframe(Brep=brep_7, Density=-1)
preview_3 = CustomPreview(Geometry=wires, Shader=ColourSwatch(SwatchColor=RGB(0, 0, 0)))

# ----
list_2 = ItemSelector(
    brep_7,
    {"Trimmed Surface", "Untrimmed Surface", "Untrimmed Surface", "Untrimmed Surface", "Untrimmed Surface", "Trimmed Surface", "Trimmed Surface", "Untrimmed Surface", "Untrimmed Surface", "Trimmed Surface", "Untrimmed Surface", "Trimmed Surface"}, selected=["Trimmed Surface", "Untrimmed Surface", "Untrimmed Surface", "Untrimmed Surface", "Untrimmed Surface", "Trimmed Surface"])

# ---- group: opaque surfaces (continued)
hbsurface_2 = HoneybeePlus_HoneybeeSurface(geo=list_2)  # -> report, HBSrf; plug-in component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

# ----
data = Data(flatten([hbsurface_2.HBSrf, hbsurface.HBSrf, hbwinsrf.HBWinSrf, hbwingroup_2.HBWinGroup]))
# This will take around an hour to run
# for the first time!
# 
# In the next few releases you should be
# able to run the analysis in parallel.
# 
# Once the analysis is over you can use
# the output to generate hourly images
# for each hour is a couple of seconds.
runradiance = HoneybeePlus_RunRadianceAnalysis(analysisRecipe=dcoeffgbrecipe, HBObjects=data, folder="c:\ladybug", name="image_based", write=toggle, run=toggle)  # -> report, legendPar, outputs; plug-in component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
genimages = HoneybeePlus_GenerateImages(imgCollection=runradiance.outputs, hoys=item_2)  # -> report, images; plug-in component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
panel_6 = Panel(genimages.report)
sethdrexposure = Honeybee_SetExposureForHDR(HDRFilePath=genimages.images, exposure=Slider(0.6, range=0..1), render=Toggle(True))  # -> outputFilePath; plug-in component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
viewer = Ladybug_ImageViewer(ImagePath_=sethdrexposure, _scale_=1, DisableClickable=False, SaveImgWithCoords=False, scale=1)  # -> ImagePath, Colors, GIF
panel_7 = Panel(viewer.GIF)
