# Grasshopper definition 09_three_phase_II_gridbased.gh (Grasshopper 1.0.4)

# Update the path to the correct folder on
# your machine.
panel = Panel("C:\Users\Mostapha\Documents\code\ladybug-tools\honeybee-grasshopper\plugin\grasshopper\sampleFiles\xmls\")
concat = Concatenate(FragmentA=panel, FragmentB="clear.xml")
concat_2 = Concatenate(FragmentA=panel, FragmentB="diffuse50.xml")
merge = Merge(Data1=concat, Data2=concat_2)

# ---- group: context!
brep = Brep([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])
panel_2 = Panel("6")

# ----
# Window Groups
# We are adding two window groups for
# this study. The skylight is its own window group
# which is not dynamic but we're interested
# to study its contribution separately.
# South window is the other window group
# which has two states: 1. clear, 2. diffuse50
# 
# Ensure that window groups are facing outwards.
# Honeybee flips the surfaces for view
# matrix calculation internally.
# 
# Window groups are under ./scene/wgroup
bsdfmaterial = HoneybeePlus_RadianceBSDFMaterial(xmlfile=merge, upVector=Vector(0.01, 0.01, 1), thickness=0)  # -> material; plug-in component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
# Context is part of the scene that won't
# change for paramteric studies. We
# just write them to a file once and include
# them in the analysis. For multi-phase
# studies it will only be part of the scene
# for daylight matrix calculation.
# 
# If copyLocal is True the file will be copied
# to ./scene/extra
# 
# NOTE: You can always create the context
# using HBSurface similar to the rest of the
# scene. This method will save you time for
# iterative studies.
# Context
hbsurface = HoneybeePlus_HoneybeeSurface(geo=brep, type=panel_2)  # -> report, HBSrf; plug-in component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
# Three phase daylight simulation example
# If this is the first time you're hearing about 3-phase simulation then first check this link:
# 
# The Three-Phase Method for Simulating Complex  Fenestration with Radiance by A McNeil, LBNL
# https://www.radiance-online.org/learning/tutorials/Tutorial-ThreePhaseMethod.pdf
# Geometry Preparation
number_slider = Slider(0.762, range=0..1)
item = ListItem(List=bsdfmaterial, Index=0, Wrap=True)  # -> Item, Item1
# Generate test points
# You can use any other grasshopper
# components to generate these points.
brep_2 = Brep(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)
gentestpts = Honeybee_GenerateTestPoints(testGeometry=brep_2, gridSize="1", distBaseSrf=number_slider, moveTestMesh=True)  # -> readMe, simplify(testPoints), simplify(ptsVectors), simplify(facesArea), simplify(mesh); plug-in component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
# Room geometry except for the openings.
# Types and materials will be assigned
# based on normal direction.
# 
# These geometries are under ./scene/opaque
brep_3 = Brep([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])

# ---- group: weathe file
path = FilePath("C:\EnergyPlusV8-6-0\WeatherData\USA_VA_Sterling-Washington.Dulles.Intl.AP.724030_TMY3.epw")

# ----
# Side windows are added to the scene
# as normal windows. They will be grouped
# together with room geometries.
# check ./scene/glazing
wires = BrepWireframe(Brep=brep_3, Density=-1)
brep_4 = Brep(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)
hbwingroupstate = HoneybeePlus_WindowGroupState(name="diffuse", radMat=item.Item1)  # -> report, state; plug-in component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
wea = HoneybeePlus_Wea(epwFile=path)  # -> wea; plug-in component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
brep_5 = Brep([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])
preview = CustomPreview(Geometry=wires, Shader=ColourSwatch(SwatchColor=RGB(0, 0, 0)))
brep_6 = Brep(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)

# ---- group: skylight
hbwingroup = HoneybeePlus_HoneybeeWindowGroup(geo=brep_6, name="skylight", radMat=item.Item)  # -> report, HBWinGroup; plug-in component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

# ---- group: side windows as part of the scene.
hbwinsrf = HoneybeePlus_HoneybeeWindowSurface(geo=brep_5, names="side_window")  # -> report, HBWinSrf; plug-in component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

# ---- group: south window
hbwingroup_2 = HoneybeePlus_HoneybeeWindowGroup(geo=brep_4, name="south_window", radMat=item.Item, states=hbwingroupstate.state)  # -> report, HBWinGroup; plug-in component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

# ----
hbsurface_2 = HoneybeePlus_HoneybeeSurface(geo=brep_3, names="room_surface")  # -> report, HBSrf; plug-in component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
# Sky Matrix
# You can use hoys input for subannual simulation.
# Sky will be created under ./sky folder.
skymatrix = HoneybeePlus_SkyMatrix(north=0, wea=wea, density=1)  # -> skymtx; plug-in component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
hbtorad = HoneybeePlus_WriteHBObjectsToRadiance(hbObjects=hbsurface.HBSrf, folder="c:\ladybug\sample_files\context", filename="context.rad", write=Toggle(True))  # -> radFile; plug-in component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
# Analysis Grid
analysisgrid = HoneybeePlus_AnalysisGrid(name="room_w_skylight", testPoints=gentestpts.testPoints, ptsVectors=gentestpts.ptsVectors)  # -> analysisGrid; plug-in component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
radscene = HoneybeePlus_RadianceScene(radFiles=hbtorad, copyLocal=True, overwrite=True)  # -> radScene; plug-in component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

# ---- group: use the results of previous study if exist
toggle = BooleanToggle(True)

# ----
# Recipe
threephasegbrecipe = HoneybeePlus_GridBasedThreePhaseDaylightRecipe(skymtx=skymatrix, analysisGrids=analysisgrid, analysisType=0, reuseVmtx=toggle, reuseDmtx=toggle)  # -> analysisRecipe; plug-in component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
# Run the simulation
# Set write to True to save the files to
# the project folder. This gives you the
# option to check the files before running
# the simulation.
# 
# Once ready also set run to True and the
# component will run the study. The output
# will be the analysis grids or an image
# collection based on the analysis type.
# 
# Results will be stored under ./result
data = Data(flatten([hbsurface_2.HBSrf, hbwingroup.HBWinGroup, hbwingroup_2.HBWinGroup, hbwinsrf.HBWinSrf]))
runradiance = HoneybeePlus_RunRadianceAnalysis(
    analysisRecipe=threephasegbrecipe,
    HBObjects=data,
    radScene=radscene,
    folder="c:\ladybug",
    name="honeybee004",
    write=Toggle(False),
    run=Toggle(False))  # -> report, legendPar, outputs; plug-in component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
panel_3 = Panel(runradiance.report)
python = PythonScript()  # -> out, a
# ---------- python: Python ----------
import honeybee
reload(honeybee.radiance.analysispoint)
reload(honeybee.radiance.analysisgrid)
# ---------- end python ----------
# Post process
# Result visualization
# Check the other file for the first two options
# for post-processing data and result visualization.
mesh = Mesh(gentestpts.mesh)

# ---- group: temporary solution until ladybug[+] is ready!
python_2 = PythonScript(x=runradiance.legendPar)  # -> a, b, c, d
# ---------- python_2: Python ----------
from System.Drawing import Color
if x:
    a = x.domain[0]
    b = x.domain[-1]
    c = 11
    d = (Color.FromArgb(1, c.r, c.g, c.b) for c in x.colors)
# ---------- end python_2 ----------

# ----
legendpar = Ladybug_LegendParameters(lowBound=python_2.a, highBound="100", numSegments=python_2.c, customColors=flatten(python_2.d))  # -> legendPar; plug-in component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
data_2 = Data(runradiance.outputs)
panel_4 = Panel(data_2)
# 4. Annual metrics - Dynamic blinds
# This workflow shows how to use a sensor to calculate
# blind states and use them to calculate the annual
# daylight metrics. In this case we want to see who far we
# need to go to keep the illuminance at the sensor less than 3000 lux.
# 
# The stratrgy is if illum > 3000 try the steps below:
# 1. change the state of the south window to diffuse (0, 1, 0).
# 2. fully close the side windows. We don't expect this to have
# a major effect considering the location of the sensor (-1, 1, 0).
# 3. close the skylight (-1, 1, -1)
panel_5 = Panel("""100
3000""")
# 3. Annual metrics
# You can use the output of any of the annual studies
# to calculate annual daylight metrics. In this example
# we are calculating Useful Daylight Autonomy (UDI)
# inside the room. As you can see the UDI is pretty low in the
# front and back of the room.
# 
# See number 4. to see how you can consider blind states
# in calculating the annual metrics.
ladybug = Ladybug_Ladybug()  # -> Vviiiiiiiiiizzz; plug-in component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
sensor = HoneybeePlus_SensorFromAnalysisGrid(analysisGrid=data_2, index=Slider(39, range=0..100))  # -> position, sensor; plug-in component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
panel_6 = Panel("""0, 1, 0
-1, 1, 0
-1, 1, -1""")
annualmetrics = HoneybeePlus_AnnualDaylightMetrics(analysisGrid=data_2, minmax=panel_5)  # -> report, DA, CDA, UDI, UDILess, UDIMore, legendPar; plug-in component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
dynblindschd = HoneybeePlus_DynamicBlindsSchedule(sensor=sensor.sensor, blindCombs=panel_6, logic="ill > 3000")  # -> report, blindStates, blindStIndex, illumTotal, illumDirect, success; plug-in component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
panel_7 = Panel(dynblindschd.report)
recolormesh = Ladybug_RecolorMesh(analysisResult=annualmetrics.UDI, inputMesh=mesh, legendPar=legendpar, analysisTitle="UDI", legendTitle="%")  # -> readMe, newMesh, newLegend, legendBasePt, meshColors, legendColors; plug-in component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

# ---- group: draw charts
toggle_2 = BooleanToggle(True)

# ----
annualmetrics_2 = HoneybeePlus_AnnualDaylightMetrics(analysisGrid=data_2, blindStates=dynblindschd.blindStates)  # -> report, DA, CDA, UDI, UDILess, UDIMore, legendPar; plug-in component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
entwine = Entwine(Branch00=dynblindschd.blindStIndex, Branch01=dynblindschd.success, Branch02=dynblindschd.illumTotal, FlattenInputs=True)
# Set to True to see the charts for the sensor.
filter = StreamFilter(Gate=toggle_2, Stream1=entwine)
bang = ExplodeTree(Data=filter)  # -> Branch0, Branch1, Branch2
# Turn on the preview of this component
# to see the effect of dynamic blinds!
# 
# Check the charts below to see what are
# the blind states based on the goal (illum < 3000)
recolormesh_2 = Ladybug_RecolorMesh(analysisResult=annualmetrics_2.CDA, inputMesh=mesh, legendPar=legendpar)  # -> readMe, newMesh, newLegend, legendBasePt, meshColors, legendColors; plug-in component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
createheader = Ladybug_CreateLBHeader(location=" ", dataType="blind combination", units="state", timeStep="Hourly", rawData=bang.Branch0)  # -> flatten(LBHeader), dataWithHeader; plug-in component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
createheader_2 = Ladybug_CreateLBHeader(location=" ", dataType="illuminance", units="lux", timeStep="Hourly", rawData=bang.Branch2)  # -> flatten(LBHeader), dataWithHeader; plug-in component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
createheader_3 = Ladybug_CreateLBHeader(
    location="-1 : Failed, 0: Met the goal w/o blinds, 1: Succeed",
    dataType="success",
    units="-",
    timeStep="Hourly",
    rawData=bang.Branch1)  # -> flatten(LBHeader), dataWithHeader; plug-in component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
gradientlibrary = Ladybug_GradientLibrary(gradIndex="15")  # -> customColors; plug-in component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
lng = ListLength(List=panel_6)
col = Colour([ColourSwatch(SwatchColor=RGBA(0, 0, 0, 194)), ColourSwatch(SwatchColor=RGB(139, 129, 123)), ColourSwatch(SwatchColor=RGB(141, 230, 253))])
subtraction = Subtraction(A=lng, B=1)
legendpar_2 = Ladybug_LegendParameters(highBound=subtraction, numSegments=lng, customColors=flatten(gradientlibrary))  # -> legendPar; plug-in component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
legendpar_3 = Ladybug_LegendParameters(lowBound="-1", highBound="1", numSegments="3", customColors=flatten(col))  # -> legendPar; plug-in component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
legendpar_4 = Ladybug_LegendParameters(highBound="3000")  # -> legendPar; plug-in component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

# ---- group: scale
panel_8 = Panel("0.01")
panel_9 = Panel("0.05")
panel_10 = Panel("0")

# ----
_3dchart = Ladybug_3DChart(
    inputData=flatten(createheader.dataWithHeader),
    basePoint="{20, 10, 0}",
    xScale=panel_8,
    yScale=panel_9,
    zScale=panel_10,
    legendPar=legendpar_2)  # -> readMe, graphMesh, graphCurves, legend, legendBasePts, title, titleBasePts, dataPts, conditionalHOY; plug-in component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
_3dchart_2 = Ladybug_3DChart(
    inputData=flatten(createheader_3.dataWithHeader),
    basePoint="{20, -7, 0}",
    xScale=panel_8,
    yScale=panel_9,
    zScale=panel_10,
    legendPar=legendpar_3)  # -> readMe, graphMesh, graphCurves, legend, legendBasePts, title, titleBasePts, dataPts, conditionalHOY; plug-in component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
_3dchart_3 = Ladybug_3DChart(
    inputData=flatten(createheader_2.dataWithHeader),
    basePoint="{20, -24, 0}",
    xScale=panel_8,
    yScale=panel_9,
    zScale=panel_10,
    legendPar=legendpar_4)  # -> readMe, graphMesh, graphCurves, legend, legendBasePts, title, titleBasePts, dataPts, conditionalHOY; plug-in component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
