# Grasshopper definition 10_three_phase_daylight_simulation.gh (Grasshopper 0.9.76)
# plug-ins: Python Interpreter

# Update the path to the correct folder on
# your machine.
panel = Panel("C:\Users\Mostapha\Documents\code\ladybug-tools\honeybee-grasshopper\plugin\grasshopper\sampleFiles\xmls\")
concat = Concatenate(FragmentA=panel, FragmentB="clear.xml")
concat_2 = Concatenate(FragmentA=panel, FragmentB="diffuse50.xml")
merge = Merge(Data1=concat, Data2=concat_2)

# ---- group: context!
brep = Brep([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])
panel_2 = Panel("6")

# ----
# Window Groups
# We are adding two window groups for
# this study. The skylight is its own window group
# which is not dynamic but we're interested
# to study its contribution separately.
# South window is the other window group
# which has two states: 1. clear, 2. diffuse50
# 
# Ensure that window groups are facing outwards.
# Honeybee flips the surfaces for view
# matrix calculation internally.
# 
# Window groups are under ./scene/wgroup
bsdfmaterial = HoneybeePlus_RadianceBSDFMaterial(xmlfile=merge, upVector=Vector(0.01, 0.01, 1), thickness=0)  # -> material; plug-in component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
# Context is part of the scene that won't
# change for paramteric studies. We
# just write them to a file once and include
# them in the analysis. For multi-phase
# studies it will only be part of the scene
# for daylight matrix calculation.
# 
# If copyLocal is True the file will be copied
# to ./scene/extra
# 
# NOTE: You can always create the context
# using HBSurface similar to the rest of the
# scene. This method will save you time for
# iterative studies.
# Context
hbsurface = HoneybeePlus_HoneybeeSurface(geo=brep, type=panel_2)  # -> report, HBSrf; plug-in component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
# Three phase daylight simulation example
# If this is the first time you're hearing about 3-phase simulation then first check this link:
# 
# The Three-Phase Method for Simulating Complex  Fenestration with Radiance by A McNeil, LBNL
# https://www.radiance-online.org/learning/tutorials/Tutorial-ThreePhaseMethod.pdf
# Geometry Preparation
number_slider = Slider(0.762, range=0..1)
item = ListItem(List=bsdfmaterial, Index=0, Wrap=True)  # -> Item, Item1
# Generate test points
# You can use any other grasshopper
# components to generate these points.
brep_2 = Brep(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)
gentestpts = Honeybee_GenerateTestPoints(testGeometry=brep_2, gridSize="1", distBaseSrf=number_slider, moveTestMesh=True)  # -> readMe, simplify(testPoints), simplify(ptsVectors), simplify(facesArea), simplify(mesh); plug-in component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
# Room geometry except for the openings.
# Types and materials will be assigned
# based on normal direction.
# 
# These geometries are under ./scene/opaque
brep_3 = Brep([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])

# ---- group: weathe file
path = FilePath("C:\EnergyPlusV8-6-0\WeatherData\USA_VA_Sterling-Washington.Dulles.Intl.AP.724030_TMY3.epw")

# ----
# Side windows are added to the scene
# as normal windows. They will be grouped
# together with room geometries.
# check ./scene/glazing
wires = BrepWireframe(Brep=brep_3, Density=-1)
brep_4 = Brep(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)
hbwingroupstate = HoneybeePlus_WindowGroupState(name="diffuse", radMat=item.Item1)  # -> report, state; plug-in component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
wea = HoneybeePlus_Wea(epwFile=path)  # -> wea; plug-in component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
brep_5 = Brep([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])
preview = CustomPreview(Geometry=wires, Shader=ColourSwatch(SwatchColor=RGB(0, 0, 0)))
brep_6 = Brep(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)

# ---- group: skylight
hbwingroup = HoneybeePlus_HoneybeeWindowGroup(geo=brep_6, name="skylight", radMat=item.Item)  # -> report, HBWinGroup; plug-in component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

# ---- group: side windows as part of the scene.
hbwinsrf = HoneybeePlus_HoneybeeWindowSurface(geo=brep_5, names="side_window")  # -> report, HBWinSrf; plug-in component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

# ---- group: south window
hbwingroup_2 = HoneybeePlus_HoneybeeWindowGroup(geo=brep_4, name="south_window", radMat=item.Item, states=hbwingroupstate.state)  # -> report, HBWinGroup; plug-in component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

# ----
hbsurface_2 = HoneybeePlus_HoneybeeSurface(geo=brep_3, names="room_surface")  # -> report, HBSrf; plug-in component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
# Sky Matrix
# You can use hoys input for subannual simulation.
# Sky will be created under ./sky folder.
skymatrix = HoneybeePlus_SkyMatrix(north=0, wea=wea, density=1)  # -> skymtx; plug-in component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
hbtorad = HoneybeePlus_WriteHBObjectsToRadiance(hbObjects=hbsurface.HBSrf, folder="c:\ladybug\sample_files\context", filename="context.rad", write=Toggle(True))  # -> radFile; plug-in component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
# Analysis Grid
analysisgrid = HoneybeePlus_AnalysisGrid(name="room_w_skylight", testPoints=gentestpts.testPoints, ptsVectors=gentestpts.ptsVectors)  # -> analysisGrid; plug-in component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
radscene = HoneybeePlus_RadianceScene(radFiles=hbtorad, copyLocal=True, overwrite=True)  # -> radScene; plug-in component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
toggle = BooleanToggle(True)
# Recipe
threephasegbrecipe = HoneybeePlus_GridBasedThreePhaseDaylightRecipe(skymtx=skymatrix, analysisGrids=analysisgrid, analysisType=0, reuseVmtx=True, reuseDmtx=True)  # -> analysisRecipe; plug-in component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
# Run the simulation
# Set write to True to save the files to
# the project folder. This gives you the
# option to check the files before running
# the simulation.
# 
# Once ready also set run to True and the
# component will run the study. The output
# will be the analysis grids or an image
# collection based on the analysis type.
# 
# Results will be stored under ./result
data = Data(flatten([hbsurface_2.HBSrf, hbwingroup.HBWinGroup, hbwingroup_2.HBWinGroup, hbwinsrf.HBWinSrf]))
runradiance = HoneybeePlus_RunRadianceAnalysis(
    analysisRecipe=threephasegbrecipe,
    HBObjects=data,
    radScene=radscene,
    folder="c:\ladybug",
    name="sample_files",
    write=Toggle(False),
    run=Toggle(False))  # -> report, legendPar, outputs; plug-in component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
panel_3 = Panel(runradiance.report)
# Result visualization
# This is an example file and so I'm showing
# different types of result visulaization inside
# the same file.
# 
# You most likely don't want to do all of
# this in a single file. Chek them from the top to bottom
mesh = Mesh(gentestpts.mesh)

# ---- group: temporary solution until ladybug[+] is ready!
python = PythonScript(x=runradiance.legendPar)  # -> a, b, c, d
# ---------- python: Python ----------
from System.Drawing import Color
if x:
    a = x.domain[0]
    b = x.domain[-1]
    c = 11
    d = (Color.FromArgb(1, c.r, c.g, c.b) for c in x.colors)
# ---------- end python ----------

# ----
legendpar = Ladybug_LegendParameters(lowBound=python.a, highBound=python.b, numSegments=python.c, customColors=flatten(python.d))  # -> legendPar; plug-in component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
data_2 = Data(runradiance.outputs)
panel_4 = Panel(data_2)
# 1. Hourly results
# This is the simplest way of visualizing the results.
# You can load the results for each hour during the year. Try to change the sliders
# for day, month and hour, You can also change the state of each light source
# by changing the blindStates input. Try the 3 cases and see how it changes the results.
ladybug = Ladybug_Ladybug()  # -> Vviiiiiiiiiizzz; plug-in component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
doy_hoy = Ladybug_DOY_HOY(days=Slider(1, range=1..30), months=Slider(1, range=1..12), hours=Slider(12, range=9..18))  # -> HOY, DOY, date; plug-in component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

# ---- group: change south window to diffuse
panel_5 = Panel("(0,1,0)")

# ---- group: remove the sky light
panel_6 = Panel("(0,0,-1)")

# ---- group: remove the south window and the skylight
panel_7 = Panel("(0,-1,-1)")

# ----
panel_8 = Panel("""-1, 0, -1
0, -1, -1
-1, -1, 0 """)
# 3. Annual metrics
# Check example file 11 for annual metrics.
# If you already run the analysis here the
# same results will be loaded!
panel_9 = Panel("""South window contribution
Side windows contribution
Skylight contribution""")
hourlyvalues = HoneybeePlus_HourlyValues(analysisGrid=data_2, hoy=doy_hoy.HOY)  # -> report, values; plug-in component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
panel_10 = Panel(hourlyvalues.report)
# 2. Hourly results break-down
# This is the same as number 1.
# 
# The only difference is we're breaking down there results for 3 different blindStates
# and show them all together.  This will help us to understand how much every
# light source is contributing to the room.
hourlyvalues_2 = HoneybeePlus_HourlyValues(analysisGrid=data_2, hoy=doy_hoy.HOY, blindState=panel_8)  # -> report, values; plug-in component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
graft = GraftTree(Tree=panel_9, IncludeEmptyLists=True, IncludeNullItems=True)
recolormesh = Ladybug_RecolorMesh(analysisResult=hourlyvalues.values, inputMesh=mesh, legendPar=legendpar, legendTitle="lux")  # -> readMe, newMesh, newLegend, legendBasePt, meshColors, legendColors; plug-in component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
panel_11 = Panel(hourlyvalues_2.report)
concat_3 = Concatenate(FragmentA=graft, FragmentB=doy_hoy.date)
recolormesh_2 = Ladybug_RecolorMesh(analysisResult=hourlyvalues_2.values, inputMesh=mesh, legendPar=legendpar, analysisTitle=concat_3, legendTitle="lux")  # -> readMe, newMesh, newLegend, legendBasePt, meshColors, legendColors; plug-in component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
# Move the graphs around!
panel_12 = Panel("""25
25
40""")
panel_13 = Panel("""8
-10
8""")
vec = VectorXYZ(XComponent=panel_12, YComponent=panel_13, ZComponent=0)  # -> graft(Vector), Length
move = Move(Geometry=recolormesh_2.newMesh, Motion=vec.Vector)  # -> Geometry, Transform
move_2 = Move(Geometry=recolormesh_2.newLegend, Motion=vec.Vector)  # -> Geometry, Transform
