# Grasshopper definition 11_five_phase_II_gridbased.gh (Grasshopper 1.0.7)

# Update the path to the correct folder on
# your machine.
python = GhPythonScript()  # -> a
# ---------- python: Python ----------
import os
a = os.path.dirname(ghenv.Component.OnPingDocument().FilePath) + r'\xmls\\'
# ---------- end python ----------
panel = Panel(python)
concat = Concatenate(FragmentA=panel, FragmentB="clear.xml")
concat_2 = Concatenate(FragmentA=panel, FragmentB="diffuse50.xml")
merge = Merge(Data1=concat, Data2=concat_2)

# ---- group: context!
brep = Brep([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])
panel_2 = Panel("6")

# ----
# Window Groups
# We are adding two window groups for
# this study. The skylight is its own window group
# which is not dynamic but we're interested
# to study its contribution separately.
# South window is the other window group
# which has two states: 1. clear, 2. diffuse50
# 
# Ensure that window groups are facing outwards.
# Honeybee flips the surfaces for view
# matrix calculation internally.
# 
# Window groups are under ./scene/wgroup
radbsdfmat = HoneybeePlus_RadianceBSDFMaterial(xmlfile=merge, up_vec=Vector(0.01, 0.01, 1), thickness=0)  # -> material; plug-in component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
# Context is part of the scene that won't
# change for paramteric studies. We
# just write them to a file once and include
# them in the analysis. For multi-phase
# studies it will only be part of the scene
# for daylight matrix calculation.
# 
# If copyLocal is True the file will be copied
# to ./scene/extra
# 
# NOTE: You can always create the context
# using HBSurface similar to the rest of the
# scene. This method will save you time for
# iterative studies.
# Context
hbsurface = HoneybeePlus_HoneybeeSurface(geo=brep, type=panel_2)  # -> report, HB_srf; plug-in component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
# Five phase daylight simulation example
# If this is the first time you're hearing about 5-phase simulation then first check this link:
# 
# The Five-Phase Method for Simulating Complex  Fenestration with Radiance by A McNeil, LBNL
# https://www.radiance-online.org/learning/tutorials/fivephasetutorialfiles/Tutorial-FivePhaseMethod_v2.pdf
txt = Text("https://www.energyplus.net/weather-download/north_and_central_america_wmo_region_4/USA/IL/USA_IL_Chicago-OHare.725300_TMY2/all")
# Geometry Preparation
number_slider = Slider(0.762, range=0..1)
downloadweather = LadybugPlus_DownloadWeather(weather_URL=txt)  # -> epw_file, stat_file, ddy_file; plug-in component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
item = ListItem(List=radbsdfmat, Index=0, Wrap=True)  # -> Item, Item1
# Generate test points
# You can use any other grasshopper
# components to generate these points.
brep_2 = Brep(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)
gentestpts = Honeybee_GenerateTestPoints(testGeometry=brep_2, gridSize="1", distBaseSrf=number_slider, moveTestMesh=True)  # -> readMe, simplify(testPoints), simplify(ptsVectors), simplify(facesArea), simplify(mesh); plug-in component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
# Room geometry except for the openings.
# Types and materials will be assigned
# based on normal direction.
# 
# These geometries are under ./scene/opaque
brep_3 = Brep([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])

# ---- group: weathe file
path = FilePath(downloadweather.epw_file)

# ----
# Side windows are added to the scene
# as normal windows. They will be grouped
# together with room geometries.
# check ./scene/glazing
wires = BrepWireframe(Brep=brep_3, Density=-1)
brep_4 = Brep(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)
wingroupstate = HoneybeePlus_WindowGroupState(name="diffuse", rad_mat=item.Item1)  # -> report, state; plug-in component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
wea = HoneybeePlus_WEAFromEPW(epw_file=path)  # -> wea; plug-in component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
brep_5 = Brep([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])
preview = CustomPreview(Geometry=wires, Shader=ColourSwatch(SwatchColor=RGB(0, 0, 0)))
brep_6 = Brep(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)

# ---- group: skylight
hbwingroup = HoneybeePlus_HoneybeeWindowGroup(geo=brep_6, name="skylight", rad_mat=item.Item)  # -> report, HB_win_group; plug-in component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

# ---- group: side windows as part of the scene.
hbwinsrf = HoneybeePlus_HoneybeeWindowSurface(geo=brep_5, names="side_window")  # -> report, HB_win_srf; plug-in component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

# ----
hbsurface_2 = HoneybeePlus_HoneybeeSurface(geo=brep_3, names="room_surface")  # -> report, HB_srf; plug-in component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

# ---- group: south window
hbwingroup_2 = HoneybeePlus_HoneybeeWindowGroup(geo=brep_4, name="south_window", rad_mat=item.Item, states=wingroupstate.state)  # -> report, HB_win_group; plug-in component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

# ----
# Sky Matrix
# You can use hoys input for subannual simulation.
# Sky will be created under ./sky folder.
skymatrix = HoneybeePlus_SkyMatrix(north=0, wea=wea, density=1)  # -> skymtx; plug-in component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
hbtorad = HoneybeePlus_WriteHBObjectsToRadiance(HB_objects=hbsurface.HB_srf, folder="c:\ladybug\sample_files\context", file_name="context.rad", write=Toggle(True))  # -> rad_file; plug-in component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
# Analysis Grid
analysisgrid = HoneybeePlus_AnalysisGrid(name="room_w_skylight", test_points=gentestpts.testPoints, pts_vectors=gentestpts.ptsVectors)  # -> analysis_grid; plug-in component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
radscene = HoneybeePlus_RadianceScene(rad_files=hbtorad, copy_local=True, overwrite=True)  # -> rad_scene; plug-in component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
toggle = BooleanToggle(True)
# Recipe
fivephasegbrecipe = HoneybeePlus_GridBasedFivePhaseDaylightRecipe(skymtx=skymatrix, analysis_grids=analysisgrid, analysis_type=0, reuse_vmtx=toggle, reuse_dmtx=toggle)  # -> analysis_recipe; plug-in component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
# Run the simulation
data = Data(flatten([hbsurface_2.HB_srf, hbwingroup.HB_win_group, hbwingroup_2.HB_win_group, hbwinsrf.HB_win_srf]))
# Set write to True to save the files to
# the project folder. This gives you the
# option to check the files before running
# the simulation.
# 
# Once ready also set run to True and the
# component will run the study. The output
# will be the analysis grids or an image
# collection based on the analysis type.
# 
# Results will be stored under ./result
runradiance = HoneybeePlus_RunRadianceAnalysis(
    analysis_recipe=fivephasegbrecipe,
    HB_objects=data,
    rad_scene=radscene,
    folder="c:\ladybug",
    name="honeybee_005",
    write=Toggle(False),
    run=Toggle(False))  # -> report, legend_par, outputs; plug-in component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
panel_3 = Panel(runradiance.report)
python_2 = PythonScript()  # -> out, a
# ---------- python_2: Python ----------
import honeybee
reload(honeybee.radiance.analysispoint)
reload(honeybee.radiance.analysisgrid)
# ---------- end python_2 ----------
# Post process
# Result visualization
# Check the other file for the first two options
# for post-processing data and result visualization.
mesh = Mesh(gentestpts.mesh)

# ---- group: temporary solution until ladybug[+] is ready!
python_3 = PythonScript(x=runradiance.legend_par)  # -> a, b, c, d
# ---------- python_3: Python ----------
from System.Drawing import Color
if x:
    a = x.min
    b = x.max
    c = 11
    d = (Color.FromArgb(1, c.r, c.g, c.b) for c in x.colors)
# ---------- end python_3 ----------

# ----
legendpar = Ladybug_LegendParameters(lowBound=python_3.a, highBound="100", numSegments=python_3.c, customColors=flatten(python_3.d))  # -> legendPar; plug-in component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
data_2 = Data(runradiance.outputs)
panel_4 = Panel(data_2)
# 4. Annual metrics - Dynamic blinds
# This workflow shows how to use a sensor to calculate
# blind states and use them to calculate the annual
# daylight metrics. In this case we want to see who far we
# need to go to keep the illuminance at the sensor less than 3000 lux.
# 
# The stratrgy is if illum > 3000 try the steps below:
# 1. change the state of the south window to diffuse (0, 1, 0).
# 2. fully close the side windows. We don't expect this to have
# a major effect considering the location of the sensor (-1, 1, 0).
# 3. close the skylight (-1, 1, -1)
panel_5 = Panel("""100
3000""")
# 3. Annual metrics
# You can use the output of any of the annual studies
# to calculate annual daylight metrics. In this example
# we are calculating Useful Daylight Autonomy (UDI)
# inside the room. As you can see the UDI is pretty low in the
# front and back of the room.
# 
# See number 4. to see how you can consider blind states
# in calculating the annual metrics.
ladybug = Ladybug_Ladybug()  # -> Vviiiiiiiiiizzz; plug-in component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
sensor = HoneybeePlus_SensorFromAnalysisGrid(analysis_grid=data_2, index=Slider(39, range=0..100))  # -> position, sensor; plug-in component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
annualmetrics = HoneybeePlus_AnnualDaylightMetrics(analysis_grid=data_2, min_max=panel_5)  # -> report, DA, CDA, UDI, UDI_less, UDI_more, legend_par; plug-in component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
panel_6 = Panel("""0, 1, 0
-1, 1, 0
-1, 1, -1""")
dynblindschd = HoneybeePlus_DynamicBlindsSchedule(sensor=sensor.sensor, blind_combs=panel_6, logic="ill > 3000")  # -> report, blind_states, blind_st_index, illum_total, illum_direct, success; plug-in component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
recolormesh = Ladybug_RecolorMesh(analysisResult=annualmetrics.UDI, inputMesh=mesh, legendPar=legendpar)  # -> readMe, newMesh, newLegend, legendBasePt, meshColors, legendColors; plug-in component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

# ---- group: draw charts
toggle_2 = BooleanToggle(False)

# ----
annualmetrics_2 = HoneybeePlus_AnnualDaylightMetrics(analysis_grid=data_2, blind_states=dynblindschd.blind_states)  # -> report, DA, CDA, UDI, UDI_less, UDI_more, legend_par; plug-in component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
entwine = Entwine(
    Branch00=dynblindschd.blind_st_index,
    Branch01=dynblindschd.success,
    Branch02=dynblindschd.illum_total,
    FlattenInputs=True)
# Set to True to see the charts for the sensor.
filter = StreamFilter(Gate=toggle_2, Stream1=entwine)
bang = ExplodeTree(Data=filter)  # -> Branch0, Branch1, Branch2
# Turn on the preview of this component
# to see the effect of dynamic blinds!
# 
# Check the charts below to see what are
# the blind states based on the goal (illum < 3000)
recolormesh_2 = Ladybug_RecolorMesh(analysisResult=annualmetrics_2.CDA, inputMesh=mesh, legendPar=legendpar)  # -> readMe, newMesh, newLegend, legendBasePt, meshColors, legendColors; plug-in component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
createheader = Ladybug_CreateLBHeader(location=" ", dataType="blind combination", units="state", timeStep="Hourly", rawData=bang.Branch0)  # -> flatten(LBHeader), dataWithHeader; plug-in component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
createheader_2 = Ladybug_CreateLBHeader(location=" ", dataType="illuminance", units="lux", timeStep="Hourly", rawData=bang.Branch2)  # -> flatten(LBHeader), dataWithHeader; plug-in component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
createheader_3 = Ladybug_CreateLBHeader(
    location="-1 : Failed, 0: Met the goal w/o blinds, 1: Succeed",
    dataType="success",
    units="-",
    timeStep="Hourly",
    rawData=bang.Branch1)  # -> flatten(LBHeader), dataWithHeader; plug-in component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
gradientlibrary = Ladybug_GradientLibrary(gradIndex="15")  # -> customColors; plug-in component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
lng = ListLength(List=panel_6)
col = Colour([ColourSwatch(SwatchColor=RGBA(0, 0, 0, 194)), ColourSwatch(SwatchColor=RGB(139, 129, 123)), ColourSwatch(SwatchColor=RGB(141, 230, 253))])
subtraction = Subtraction(A=lng, B=1)
legendpar_2 = Ladybug_LegendParameters(highBound=subtraction, numSegments=lng, customColors=flatten(gradientlibrary))  # -> legendPar; plug-in component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
legendpar_3 = Ladybug_LegendParameters(lowBound="-1", highBound="1", numSegments="3", customColors=flatten(col))  # -> legendPar; plug-in component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
legendpar_4 = Ladybug_LegendParameters(highBound="3000")  # -> legendPar; plug-in component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

# ---- group: scale
panel_7 = Panel("0.01")
panel_8 = Panel("0.05")
panel_9 = Panel("0")

# ----
_3dchart = Ladybug_3DChart(
    inputData=flatten(createheader.dataWithHeader),
    basePoint="{20, 10, 0}",
    xScale=panel_7,
    yScale=panel_8,
    zScale=panel_9,
    legendPar=legendpar_2)  # -> readMe, graphMesh, graphCurves, legend, legendBasePts, title, titleBasePts, dataPts, conditionalHOY; plug-in component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
_3dchart_2 = Ladybug_3DChart(
    inputData=flatten(createheader_3.dataWithHeader),
    basePoint="{20, -7, 0}",
    xScale=panel_7,
    yScale=panel_8,
    zScale=panel_9,
    legendPar=legendpar_3)  # -> readMe, graphMesh, graphCurves, legend, legendBasePts, title, titleBasePts, dataPts, conditionalHOY; plug-in component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
_3dchart_3 = Ladybug_3DChart(
    inputData=flatten(createheader_2.dataWithHeader),
    basePoint="{20, -24, 0}",
    xScale=panel_7,
    yScale=panel_8,
    zScale=panel_9,
    legendPar=legendpar_4)  # -> readMe, graphMesh, graphCurves, legend, legendBasePts, title, titleBasePts, dataPts, conditionalHOY; plug-in component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
